# Dynamo graph MainWithInferenceWithoutTraining.dyn (Dynamo 2.10.1.3976)

# group: GetFloorPlanElementID
element_types = ElementTypes("ViewPlan")
all_elements_of_type = ElementsOfType(element_type=element_types)
viewplan_selector = CodeBlock(IN=all_elements_of_type) { OUT=IN[0]; }
id = Element.Id(element=viewplan_selector)

# group: Settings: Geometry
default_exterior_wall_types = WallTypes("Generic - 300mm")
default_floor_types = FloorTypes("Generic 300mm")
default_interior_wall_types = WallTypes("Generic - 300mm")
SITE_X = DoubleSlider(25, range=20..60 step 5)  # graph input
SITE_Y = DoubleSlider(20, range=10..40 step 5)  # graph input
corridor_width = DoubleSlider(2, range=2..4 step 1)  # graph input
NUM_ROOMS_SHORT_SIDE = DoubleSlider(3, range=2..15 step 1)  # graph input
NUM_ROOMS_LONG_SIDE = DoubleSlider(3, range=2..15 step 1)  # graph input
INCLUDE_BOTTLENECK = BoolSelector(false)  # graph input
door_width = DoubleInput(0.8)
obstacle_width = DoubleInput(0.8)
room_width = DoubleInput(0.8)
geometry_shape_1_multilevel_2 = DoubleSlider(1, range=1..4 step 1)  # "Geometry Shape: 1 = MultiLevel; 2 = Cross; 3 = E2E; 4 = Edge"; graph input

# group: Settings: Forward Pass
createFloorPlanWithOverlaidZones = BoolSelector(false)
virtual_environment_path = Directory("D:\Work\TUM_Research\HiWiPatrick\PedSimAutomation\DynamoDependencies\DynamoVEnv")
paddedimagewidth_int = DoubleInput(640)
paddedimageheight_int = DoubleInput(640)
nn_checkpoint_path = Directory("C:\Users\mohab\Documents\TUM\HiWiPatrick\PedSimAutomation\DynamoDependencies\PlaceholderScripts\forwardPass")
gif_export_path = Directory("C:\Users\mohab\Documents\TUM\HiWiPatrick\PedSimAutomation\DynamoDependencies\PlaceholderScripts\forwardPass")

# group: Preprocessor Scripts
parameterPreprocessor = Python(IN[0]=SITE_X, IN[1]=SITE_Y, IN[2]=corridor_width, IN[3]=NUM_ROOMS_SHORT_SIDE, IN[4]=NUM_ROOMS_LONG_SIDE, IN[5]=INCLUDE_BOTTLENECK)  # CPython3
# ---------- parameterPreprocessor.python (25 lines) ----------
# Phython-Standard- und DesignScript-Bibliotheken laden
import sys
import os
import clr
clr.AddReference('ProtoGeometry')
from Autodesk.DesignScript.Geometry import *

# Die Eingaben für diesen Block werden in Form einer Liste in den IN-Variablen gespeichert.
dataEnteringNode = IN

# Code unterhalb dieser Linie platzieren
site_x = int(IN[0])                                # the overall length of the site
site_y = int(IN[1])                                # the overall widthness of the site
CORR_WIDTH = int(IN[2]) # convert_meter_to_unit(3)
NUM_ROOMS_SHORT_SIDE = int(IN[3])
NUM_ROOMS_LONG_SIDE = int(IN[4])
INCLUDE_BOTTLENECK = bool(IN[5])
#store_dir = IN[6]
#layout_name = IN[7]


txt_filename = \
    'floorplan_siteX_'+str(int(site_x))+'_siteY_'+str(int(site_y))+'_CORRWIDTH_'+str(CORR_WIDTH)+ '_NUMROOMS_'+str(NUM_ROOMS_SHORT_SIDE)+'_'+str(NUM_ROOMS_LONG_SIDE)+'_INCBNECK_'+str(INCLUDE_BOTTLENECK)+'.txt'
# Weisen Sie Ihre Ausgabe der OUT-Variablen zu.
OUT = txt_filename, [site_x, site_y, CORR_WIDTH, NUM_ROOMS_SHORT_SIDE, NUM_ROOMS_LONG_SIDE, INCLUDE_BOTTLENECK]
# ----------------------------------------
modelSelector = Python(IN[0]=geometry_shape_1_multilevel_2, IN[1]=createFloorPlanWithOverlaidZones)  # CPython3
# ---------- modelSelector.python (12 lines) ----------
# Load the Python Standard and DesignScript Libraries
import sys
import clr
clr.AddReference('ProtoGeometry')
from Autodesk.DesignScript.Geometry import *

is_geometry = [False for _ in range(4)]

if not IN[1] : 
    is_geometry[int(IN[0]) - 1] = True
    
OUT = is_geometry
# ----------------------------------------

# group: Geometry Creators
multiLevelGeometryCreator = Python(IN[0]=default_exterior_wall_types, IN[1]=default_floor_types, IN[2]=default_interior_wall_types, IN[3]=parameterPreprocessor, IN[4]=door_width, IN[5]=obstacle_width, IN[6]=room_width, IN[7]=modelSelector)  # CPython3
# ---------- multiLevelGeometryCreator.python (419 lines) ----------
###############################################################
# Load the Libraries
###############################################################
import os
import clr
import sys
import math
import System
import time

from System import Array
from System.Collections.Generic import *

clr.AddReference("RevitNodes")
import Revit

clr.ImportExtensions(Revit.Elements)
clr.ImportExtensions(Revit.GeometryConversion)

clr.AddReference("RevitServices")
import RevitServices
from RevitServices.Persistence import DocumentManager 
from RevitServices.Transactions import TransactionManager 

clr.AddReference("RevitAPI")
clr.AddReference("RevitAPIUI")

clr.AddReference('ProtoGeometry')
import Autodesk 
from Autodesk.DesignScript.Geometry import *
from Autodesk.Revit.DB import *
#from Autodesk.Revit.UI import *
from Autodesk.Revit.DB import StairsEditScope
from Autodesk.Revit.DB import Parameter
from Autodesk.Revit.DB.Architecture import StairsRun
from Autodesk.Revit.DB.Architecture import *
from Autodesk.Revit.DB import IFailuresPreprocessor

###############################################################
# Customize functions 
###############################################################
"""
Converts default unit in Dynamo into meter...
"""
def convert_meter_to_unit(pre_value):
    tempo_list = []
    tempo_value = 0
    if isinstance(pre_value, list):
        len_list = len(pre_value)
        for ii in range(len_list):
            tempo_list.append (float(UnitUtils.ConvertToInternalUnits(pre_value[ii], UnitTypeId.Meters)))
        pre_value = tempo_list
    else:
        tempo_value = float(UnitUtils.ConvertToInternalUnits(pre_value, UnitTypeId.Meters))
        pre_value = tempo_value
    return pre_value


def convert_to_meter(internal_value):
	if isinstance(internal_value, list):
		return [UnitUtils.ConvertFromInternalUnits(value, UnitTypeId.Meters) for value in internal_value]
	return float(UnitUtils.ConvertFromInternalUnits(internal_value, UnitTypeId.Meters))

"""
Provide perimeter lines from three dimensions...
"""
def find_perimeter_lines(x,y,z):
    line_list = []
    xx = x
    yy = y
    zz = z 
    # print "find_perimeter_lines x: " + str(x)
    # print "find_perimeter_lines y: " + str(y)
    # print "find_perimeter_lines z: " + str(z)
	
    line_1 = Autodesk.Revit.DB.Line.CreateBound(XYZ(0,0,zz),    XYZ(xx,0,zz))
    line_2 = Autodesk.Revit.DB.Line.CreateBound(XYZ(xx,0,zz),   XYZ(xx,yy,zz))
    line_3 = Autodesk.Revit.DB.Line.CreateBound(XYZ(xx,yy,zz),  XYZ(0,yy,zz))
    line_4 = Autodesk.Revit.DB.Line.CreateBound(XYZ(0,yy,zz),   XYZ(0,0,zz))

    line_list.append(line_1)
    line_list.append(line_2)
    line_list.append(line_3)
    line_list.append(line_4)
    
    return line_list

def create_slab_geometry(x_min , x_max , y_min , y_max , z) : 

    bottom_left_point = XYZ(x_min , y_min , z)
    bottom_right_point = XYZ(x_max , y_min , z)
    top_right_point = XYZ(x_max , y_max , z)
    top_left_point = XYZ(x_min , y_max , z)

    bottom_line = Autodesk.Revit.DB.Line.CreateBound(bottom_left_point , bottom_right_point)
    right_vertical_line = Autodesk.Revit.DB.Line.CreateBound(bottom_right_point , top_right_point)
    top_line = Autodesk.Revit.DB.Line.CreateBound(top_right_point , top_left_point)
    left_vertical_line = Autodesk.Revit.DB.Line.CreateBound(top_left_point , bottom_left_point)

    slab_geometry = CurveArray()
    slab_geometry.Append(bottom_line)
    slab_geometry.Append(right_vertical_line)
    slab_geometry.Append(top_line)
    slab_geometry.Append(left_vertical_line)

    return slab_geometry

def create_one_stair(start_x , start_y , start_z , end_x , end_y , end_z , level , floor_type) : 
    stair_thickness = end_z - start_z
    
    stair_type = floor_type.Duplicate(f"{stair_thickness}_starts_at_{start_x}_{start_y}_{start_z}_at_{time.time()}")
    compound = stair_type.GetCompoundStructure()
    compound.SetLayerWidth(0, stair_thickness)
    stair_type.SetCompoundStructure(compound)
    
    stair_geom = create_slab_geometry(start_x , end_x , start_y , end_y , start_z + stair_thickness)
    
    return doc.Create.NewFloor(stair_geom , stair_type , level , True)

"""
Provide the geometry of slab by level...
"""
def slab_geometry_by_level(x,y,level,delta_z):
    return create_slab_geometry(0. , x , 0. , y , level.Elevation + delta_z)

def create_staircase(start_x , start_y , start_level , end_x , end_y , end_level , thickness , floor_type , inXDirection = False) : 
    number_stairs = int((end_level.Elevation - start_level.Elevation) / min(thickness , end_level.Elevation - start_level.Elevation))
    thickness = (end_level.Elevation - start_level.Elevation) / float(number_stairs) if number_stairs > 1 else thickness

    if inXDirection :
        stair_delta_x = (end_x - start_x) / float(number_stairs)
        stair_delta_y = end_y - start_y
        translation_vector = XYZ(stair_delta_x , 0. , thickness)
    else : 
        stair_delta_x = end_x - start_x
        stair_delta_y = (end_y - start_y) / float(number_stairs)
        translation_vector = XYZ(0. , stair_delta_y , thickness)

    initial_stair = create_one_stair(start_x , start_y , start_level.Elevation , start_x + stair_delta_x , start_y + stair_delta_y , start_level.Elevation + thickness , start_level , floor_type)

    stair_ids = [initial_stair.Id]
    for _ in range(number_stairs - 1) : 
        stair_id = ElementTransformUtils.CopyElement(doc , stair_ids[-1] , translation_vector)
        stair_ids.append(stair_id[0])

    return stair_ids

###############################################################
# Current doc/app/ui
###############################################################
doc = DocumentManager.Instance.CurrentDBDocument
# uiapp = DocumentManager.Instance.CurrentUIApplication 
# app = uiapp.Application
# uidoc = uiapp.ActiveUIDocument

###############################################################
# Prepare the input
###############################################################
default_exterior_wall_type = UnwrapElement(IN[0])                   # Default exterior wall type
default_floor_type = UnwrapElement(IN[1])                           # Default Floor type
default_interior_wall_type = UnwrapElement(IN[2])				# Default interior wall type
### INPUT PARAMETERS ###
parameter_list = IN[3][1]
site_x = parameter_list[0]                                # the overall length of the site
site_y = parameter_list[1]                                # the overall widthness of the site
CORR_WIDTH = parameter_list[2]
MIN_ROOM_LENGTH = parameter_list[3]
INCLUDE_BOTTLENECK = parameter_list[4]
create_mode = IN[7][0]
DOOR_WIDTH_H = convert_meter_to_unit(float(IN[4])/2.)
OBSTACLE_WIDTH  = float(IN[5])
ROOM_WIDTH = convert_meter_to_unit(float(IN[6]))

number_story = 3                                          # the total amount of the stories;
story_z = [0 , 2 , 4]
site_z = 6                                              # the overall height of the site
ref_level_z = 0                                         # the z-position of the reference level (default level = level 0, created in the prepared .rvt)
###############################################################
# Transaction in Revit
###############################################################
TransactionManager.Instance.EnsureInTransaction(doc)
###############################################################
# Define the output
###############################################################

# Create room dict
room_dict = {}

if create_mode:
    geo_site = []                                                       # archive all the input data
    ref_level = []                                                      # the reference level
    bbox_site = []                                                      # bounding box of the site

    # sys.path.append('C:\Users\ga78jem\Miniconda3\envs\trajectron++\Lib\site-packages')

    ###############################################################
    # Convert the Units | b = UnitUtils.ConvertToInternalUnits(a, UnitTypeId.Meters)  b = a*3 | c = UnitUtils.ConvertFromInternalUnits(a, UnitTypeId.Meters)  c = a*3
    ###############################################################

    # print "site x before conversion:" + str(site_x)
    # adjust the sizes to account for wall thickness
    site_x -= 0.3
    site_y -= 0.3
    site_x = convert_meter_to_unit(site_x)
    site_y = convert_meter_to_unit(site_y)
    site_z = convert_meter_to_unit(site_z)
    ref_level_z = convert_meter_to_unit(ref_level_z)
    CORR_WIDTH = convert_meter_to_unit(CORR_WIDTH)
    MIN_ROOM_LENGTH = convert_meter_to_unit(MIN_ROOM_LENGTH)
    
    # print "site x after conversion:" + str(site_x)

    ###############################################################
    # Delete all levels apart from the reference level (when there are multiple levels)
    ###############################################################
    # Collect all levels
    levelArray = (FilteredElementCollector(doc)
        .OfCategory(BuiltInCategory.OST_Levels)
        .WhereElementIsNotElementType()
        .ToElements())

    def clear_model(bool_value):
        if bool_value:
            del_grid = FilteredElementCollector(doc).OfCategory(BuiltInCategory.OST_Grids).WhereElementIsNotElementType().ToElements()
            del_door = FilteredElementCollector(doc).OfCategory(BuiltInCategory.OST_Doors).WhereElementIsNotElementType().ToElements()
            del_floor = FilteredElementCollector(doc).OfCategory(BuiltInCategory.OST_Floors).WhereElementIsNotElementType().ToElements()
            del_wall = FilteredElementCollector(doc).OfCategory(BuiltInCategory.OST_Walls).WhereElementIsNotElementType().ToElements()
            del_roof = FilteredElementCollector(doc).OfCategory(BuiltInCategory.OST_Roofs).WhereElementIsNotElementType().ToElements()
            del_all = [del_grid, del_door, del_floor, del_wall, del_roof]
            for element_type in del_all:
                for element in element_type:
                    doc.Delete(element.Id)

    clear_model(True)

    # Check the number of the existing levels, if multiple, delete and save only one
    if len(levelArray) > 1:
        #print "levelArray.Count > 1, from 01_Site"
        for levelElement in levelArray:
            if levelElement.Elevation != ref_level_z:
                doc.Delete(levelElement.Id)
    ref_level = levelArray[0]
    ref_level.Name = "Story Level 0"

    # Check the if the saved one is the reference level, correct it if not
    if ref_level.Elevation != ref_level_z:
        ref_level_new = Autodesk.Revit.DB.Level.Create(doc, ref_level_z)
        doc.Delete(ref_level.Id)
        ref_level = ref_level_new
        ref_level.Name = "Story Level 0"

    #--------------------------------------------------------------
    #------------------ OK NOW YOU CAN CODE -----------------------
    #--------------------------------------------------------------

    # Create Bounding Box
    bb = BoundingBoxXYZ()
    bb.Min = XYZ(0, 0, 0)
    bb.Max = XYZ(0, 0, site_z)
    bbox_site.append(bb.ToProtoType())                  # the bounding box of the entire site
    # Close and save the recording file
    # geo_site.append(site_x)
    # geo_site.append(site_y)
    # geo_site.append(site_z)

    ###############################################################
    # END OF SCRIPT 1
    # START OF SCRIPT 2
    ###############################################################

    archive_data = []                                                   # archive all the input data
    bbox_story = []
    exterior_wall_list = []
    floor_list = []
    roof_list = []
    entrance_door_list = []

    ###############################################################
    # Convert the Units | b = UnitUtils.ConvertToInternalUnits(a, UnitTypeId.Meters)  b = a*3 | c = UnitUtils.ConvertFromInternalUnits(a, UnitTypeId.Meters)  c = a*3
    ###############################################################
    story_z = convert_meter_to_unit(story_z)

    # Collect all levels
    levelArray = (FilteredElementCollector(doc)
        .OfCategory(BuiltInCategory.OST_Levels)
        .WhereElementIsNotElementType()
        .ToElements())

    # Check the number of the existing levels, if multiple, delete and save only one
    if len(levelArray) > 1:
        #print "levelArray.Count > 1, from 02_Story"
        for levelElement in levelArray:
            if levelElement.Elevation != ref_level.Elevation:
                doc.Delete(levelElement.Id)
    ref_level = levelArray[0]
    ref_level.Name = "Story Level 0"

    # Check the if the saved one is the reference level, correct it if not
    if ref_level.Elevation != 0:
        ref_level_new = Autodesk.Revit.DB.Level.Create(doc, 0)
        doc.Delete(ref_level.Id)
        ref_level = ref_level_new
        ref_level.Name = "Story Level 0"

    ###############################################################
    # Check the consistence with the bouning box of the side 
    ###############################################################
    # Check the z-position of the highest story against the site box

    check_site_story = True if max(story_z) < site_z else False
    #print "The stories are consistent with the overal site:" + str(check_site_story)

    # Create new story levels
    for ii in range(number_story):
        if ref_level.Elevation == story_z[ii]:
            continue
        new_level = Autodesk.Revit.DB.Level.Create(doc, story_z[ii])
        new_level.Name = "Story Level " + str(ii)

    # Create the roof level
    roof_level = Autodesk.Revit.DB.Level.Create(doc, site_z)
    roof_level.Name = "Roof Level"

    # all levels
    allLevels = FilteredElementCollector(doc).OfClass(Level).ToElements()

    # Create Bounding Box for each story level
    for ii in range(number_story):
        level_bbox_end_z = story_z[ii+1] if ii < (number_story-1) else site_z
        #print "Story"+str(ii)
        #print str(level_bbox_end_z)
        bb = BoundingBoxXYZ()
        bb.Min = XYZ(0, 0, story_z[ii])
        bb.Max = XYZ(site_x, site_y, level_bbox_end_z)
        bbox_story.append(bb.ToProtoType())

    ##############################################################################################################################
    ##############################################################################################################################
    # Create floorplan complexity
    ##############################################################################################################################
    ##############################################################################################################################

    LENGTH = site_x
    WIDTH = site_y
    print('x_length: ' + str(convert_to_meter(LENGTH)))
    print('y_width: ' + str(convert_to_meter(WIDTH)))
    z_level = ref_level.Elevation
    ceiling = allLevels[0].Elevation

    DOOR_HEIGHT = convert_meter_to_unit(2.2)
    DOOR_THICKNESS_H = convert_meter_to_unit(0.25)

    obstacle_counter = 0

    # Create the exterior walls
    perimeter_lines = find_perimeter_lines(LENGTH, WIDTH, z_level)
    for ww in range(4):
        wall = Wall.Create(doc, perimeter_lines[ww], default_exterior_wall_type.Id, ref_level.Id, site_z, 0, False, True)
        exterior_wall_list.append(wall)

    # Create floor for each story level
    for ii in range(number_story):
        ll = allLevels[ii]
        floor_geometry = slab_geometry_by_level(LENGTH, WIDTH, ll, 0.0)
        floor = doc.Create.NewFloor(floor_geometry, default_floor_type, ll, True)
        floor_list.append(floor)

    floor_plan_family_type = None
    for view_type in FilteredElementCollector(doc).OfClass(ViewFamilyType):
        if view_type.ViewFamily == ViewFamily.FloorPlan:
            floor_plan_family_type = view_type
            break
    
    floor_plan_views = []
    for level in allLevels[1:]:
        floor_plan_view = ViewPlan.Create(doc, floor_plan_family_type.Id, level.Id)
        floor_plan_view.Name = level.Name
        floor_plan_views.append(floor_plan_view)

    stair_thickness = (allLevels[-1].Elevation - allLevels[-2].Elevation) / 4

    # stairs = create_staircase(
    #     start_x = site_x / 8. , 
    #     start_y = site_y / 4. , 
    #     start_level = allLevels[1] , 
    #     end_x = site_x / 2. , 
    #     end_y = site_y / 2. , 
    #     end_level = allLevels[2] , 
    #     thickness = stair_thickness , 
    #     floor_type = default_floor_type , 
    #     inXDirection = False
    # )
    # stairs = create_staircase(
    #     start_x = site_x / 8. , 
    #     start_y = site_y / 4. , 
    #     start_level = allLevels[0] , 
    #     end_x = site_x / 2. , 
    #     end_y = site_y / 2. , 
    #     end_level = allLevels[1] , 
    #     thickness = stair_thickness , 
    #     floor_type = default_floor_type , 
    #     inXDirection = False
    # )

    # floor_cutting_curve = create_slab_geometry(site_x / 2. , 3 * site_x / 4. , site_y / 2. , 3 * site_y / 4. , 0.)
    # floor_cutting = doc.Create.NewOpening(doc.GetElement(floor_list[1].Id), floor_cutting_curve, False)


    
#--------------------------------------------------------------
#------------------ OK NOW END THE CODE -----------------------
#--------------------------------------------------------------

    TransactionManager.Instance.TransactionTaskDone()

###############################################################
# Prepare the output 
###############################################################
    OUT = room_dict , floor_list , allLevels , site_x , site_y
# ----------------------------------------
crossGeometryCreator = Python(IN[0]=default_exterior_wall_types, IN[1]=default_floor_types, IN[2]=default_interior_wall_types, IN[3]=parameterPreprocessor, IN[4]=door_width, IN[5]=obstacle_width, IN[6]=room_width, IN[7]=modelSelector)  # CPython3
# ---------- crossGeometryCreator.python (489 lines) ----------
###############################################################
# Load the Libraries Cross 5,6 = door obstacle widths
###############################################################
import os
import clr
import sys
import math
import System

from System import Array
from System.Collections.Generic import *

clr.AddReference("RevitNodes")
import Revit

clr.ImportExtensions(Revit.Elements)
clr.ImportExtensions(Revit.GeometryConversion)

clr.AddReference("RevitServices")
import RevitServices
from RevitServices.Persistence import DocumentManager 
from RevitServices.Transactions import TransactionManager 

clr.AddReference("RevitAPI")
clr.AddReference("RevitAPIUI")

clr.AddReference('ProtoGeometry')
import Autodesk 
from Autodesk.DesignScript.Geometry import *
from Autodesk.Revit.DB import *
#from Autodesk.Revit.UI import *
from Autodesk.Revit.DB import StairsEditScope
from Autodesk.Revit.DB import Parameter
from Autodesk.Revit.DB.Architecture import StairsRun
from Autodesk.Revit.DB.Architecture import *
from Autodesk.Revit.DB import IFailuresPreprocessor

###############################################################
# Customize functions 
###############################################################
"""
Converts default unit in Dynamo into meter...
"""
def convert_meter_to_unit(pre_value):
    tempo_list = []
    tempo_value = 0
    if isinstance(pre_value, list):
        len_list = len(pre_value)
        for ii in range(len_list):
            tempo_list.append (float(UnitUtils.ConvertToInternalUnits(pre_value[ii], UnitTypeId.Meters)))
        pre_value = tempo_list
    else:
        tempo_value = float(UnitUtils.ConvertToInternalUnits(pre_value, UnitTypeId.Meters))
        pre_value = tempo_value
    return pre_value


def convert_to_meter(internal_value):
	if isinstance(internal_value, list):
		return [UnitUtils.ConvertFromInternalUnits(value, UnitTypeId.Meters) for value in internal_value]
	return float(UnitUtils.ConvertFromInternalUnits(internal_value, UnitTypeId.Meters))

"""
Provide perimeter lines from three dimensions...
"""
def find_perimeter_lines(x,y,z):
    line_list = []
    xx = x
    yy = y
    zz = z 
    # print "find_perimeter_lines x: " + str(x)
    # print "find_perimeter_lines y: " + str(y)
    # print "find_perimeter_lines z: " + str(z)
	
    line_1 = Autodesk.Revit.DB.Line.CreateBound(XYZ(0,0,zz),    XYZ(xx,0,zz))
    line_2 = Autodesk.Revit.DB.Line.CreateBound(XYZ(xx,0,zz),   XYZ(xx,yy,zz))
    line_3 = Autodesk.Revit.DB.Line.CreateBound(XYZ(xx,yy,zz),  XYZ(0,yy,zz))
    line_4 = Autodesk.Revit.DB.Line.CreateBound(XYZ(0,yy,zz),   XYZ(0,0,zz))

    line_list.append(line_1)
    line_list.append(line_2)
    line_list.append(line_3)
    line_list.append(line_4)
    
    return line_list

"""
Provide the geometry of slab by level...
"""
def slab_geometry_by_level(x,y,level,delta_z):
    zz = level.Elevation + delta_z
    xx = x
    yy = y 
    line_1 = Autodesk.Revit.DB.Line.CreateBound(XYZ(0,0,zz),    XYZ(xx,0,zz))
    line_2 = Autodesk.Revit.DB.Line.CreateBound(XYZ(xx,0,zz),   XYZ(xx,yy,zz))
    line_3 = Autodesk.Revit.DB.Line.CreateBound(XYZ(xx,yy,zz),  XYZ(0,yy,zz))
    line_4 = Autodesk.Revit.DB.Line.CreateBound(XYZ(0,yy,zz),   XYZ(0,0,zz))
    
    slab_geometry = CurveArray()
    slab_geometry.Append(line_1)
    slab_geometry.Append(line_2)
    slab_geometry.Append(line_3)
    slab_geometry.Append(line_4)
    return slab_geometry

###############################################################
# Current doc/app/ui
###############################################################
doc = DocumentManager.Instance.CurrentDBDocument
# uiapp = DocumentManager.Instance.CurrentUIApplication 
# app = uiapp.Application
# uidoc = uiapp.ActiveUIDocument

###############################################################
# Prepare the input
###############################################################
default_exterior_wall_type = UnwrapElement(IN[0])                   # Default exterior wall type
default_floor_type = UnwrapElement(IN[1])                           # Default Floor type
default_interior_wall_type = UnwrapElement(IN[2])				# Default interior wall type
### INPUT PARAMETERS ###
parameter_list = IN[3][1]
site_x = parameter_list[0]                                # the overall length of the site
site_y = parameter_list[1]                                # the overall widthness of the site
CORR_WIDTH = parameter_list[2] # convert_meter_to_unit(3)
NUM_ROOMS_PER_SIDE = parameter_list[3]
INCLUDE_BOTTLENECK = parameter_list[4]
create_mode = IN[7][1]
DOOR_WIDTH_H = convert_meter_to_unit(float(IN[4])/2.)
OBSTACLE_WIDTH = float(IN[5])

number_story = 1                                          # the total amount of the stories;
story_z = [0]
site_z = 4                                              # the overall height of the site
ref_level_z = 0                                         # the z-position of the reference level (default level = level 0, created in the prepared .rvt)
###############################################################
# Transaction in Revit
###############################################################
TransactionManager.Instance.EnsureInTransaction(doc)
###############################################################
# Define the output
###############################################################

# Create room dict
room_dict = {}

if create_mode:
    geo_site = []                                                       # archive all the input data
    ref_level = []                                                      # the reference level
    bbox_site = []                                                      # bounding box of the site

    # sys.path.append('C:\Users\ga78jem\Miniconda3\envs\trajectron++\Lib\site-packages')

    ###############################################################
    # Convert the Units | b = UnitUtils.ConvertToInternalUnits(a, UnitTypeId.Meters)  b = a*3 | c = UnitUtils.ConvertFromInternalUnits(a, UnitTypeId.Meters)  c = a*3
    ###############################################################

    # print "site x before conversion:" + str(site_x)
    # adjust the sizes to account for wall thickness
    site_x -= 0.3
    site_y -= 0.3
    # convert to Revit units
    site_x = convert_meter_to_unit(site_x)
    site_y = convert_meter_to_unit(site_y)
    site_z = convert_meter_to_unit(site_z)
    ref_level_z = convert_meter_to_unit(ref_level_z)
    CORR_WIDTH = convert_meter_to_unit(CORR_WIDTH)
    # print "site x after conversion:" + str(site_x)

    ###############################################################
    # Delete all levels apart from the reference level (when there are multiple levels)
    ###############################################################
    # Collect all levels
    levelArray = (FilteredElementCollector(doc)
        .OfCategory(BuiltInCategory.OST_Levels)
        .WhereElementIsNotElementType()
        .ToElements())

    def clear_model(bool_value):
        if bool_value:
            del_grid = FilteredElementCollector(doc).OfCategory(BuiltInCategory.OST_Grids).WhereElementIsNotElementType().ToElements()
            del_door = FilteredElementCollector(doc).OfCategory(BuiltInCategory.OST_Doors).WhereElementIsNotElementType().ToElements()
            del_floor = FilteredElementCollector(doc).OfCategory(BuiltInCategory.OST_Floors).WhereElementIsNotElementType().ToElements()
            del_wall = FilteredElementCollector(doc).OfCategory(BuiltInCategory.OST_Walls).WhereElementIsNotElementType().ToElements()
            del_roof = FilteredElementCollector(doc).OfCategory(BuiltInCategory.OST_Roofs).WhereElementIsNotElementType().ToElements()
            del_all = [del_grid, del_door, del_floor, del_wall, del_roof]
            for element_type in del_all:
                for element in element_type:
                    doc.Delete(element.Id)

    clear_model(True)

    # Check the number of the existing levels, if multiple, delete and save only one
    if len(levelArray) > 1:
        #print "levelArray.Count > 1, from 01_Site"
        for levelElement in levelArray:
            if levelElement.Elevation != ref_level_z:
                doc.Delete(levelElement.Id)
    ref_level = levelArray[0]
    ref_level.Name = "Story Level 0"

    # Check the if the saved one is the reference level, correct it if not
    if ref_level.Elevation != ref_level_z:
        ref_level_new = Autodesk.Revit.DB.Level.Create(doc, ref_level_z)
        doc.Delete(ref_level.Id)
        ref_level = ref_level_new
        ref_level.Name = "Story Level 0"

    #--------------------------------------------------------------
    #------------------ OK NOW YOU CAN CODE -----------------------
    #--------------------------------------------------------------

    # Create Bounding Box
    bb = BoundingBoxXYZ()
    bb.Min = XYZ(0, 0, 0)
    bb.Max = XYZ(0, 0, site_z)
    bbox_site.append(bb.ToProtoType())                  # the bounding box of the entire site
    # Close and save the recording file
    # geo_site.append(site_x)
    # geo_site.append(site_y)
    # geo_site.append(site_z)

    ###############################################################
    # END OF SCRIPT 1
    # START OF SCRIPT 2
    ###############################################################

    archive_data = []                                                   # archive all the input data
    bbox_story = []
    exterior_wall_list = []
    floor_list = []
    roof_list = []
    entrance_door_list = []

    ###############################################################
    # Convert the Units | b = UnitUtils.ConvertToInternalUnits(a, UnitTypeId.Meters)  b = a*3 | c = UnitUtils.ConvertFromInternalUnits(a, UnitTypeId.Meters)  c = a*3
    ###############################################################
    story_z = convert_meter_to_unit(story_z)

    # Collect all levels
    levelArray = (FilteredElementCollector(doc)
        .OfCategory(BuiltInCategory.OST_Levels)
        .WhereElementIsNotElementType()
        .ToElements())

    # Check the number of the existing levels, if multiple, delete and save only one
    if len(levelArray) > 1:
        #print "levelArray.Count > 1, from 02_Story"
        for levelElement in levelArray:
            if levelElement.Elevation != ref_level.Elevation:
                doc.Delete(levelElement.Id)
    ref_level = levelArray[0]
    ref_level.Name = "Story Level 0"

    # Check the if the saved one is the reference level, correct it if not
    if ref_level.Elevation != 0:
        ref_level_new = Autodesk.Revit.DB.Level.Create(doc, 0)
        doc.Delete(ref_level.Id)
        ref_level = ref_level_new
        ref_level.Name = "Story Level 0"

    ###############################################################
    # Check the consistence with the bouning box of the side 
    ###############################################################
    # Check the z-position of the highest story against the site box

    check_site_story = True if max(story_z) < site_z else False
    #print "The stories are consistent with the overal site:" + str(check_site_story)

    # Create new story levels
    for ii in range(number_story):
        if ref_level.Elevation == story_z[ii]:
            continue
        new_level = Autodesk.Revit.DB.Level.Create(doc, story_z[ii])
        new_level.Name = "Story Level " + str(ii)

    # Create the roof level
    roof_level = Autodesk.Revit.DB.Level.Create(doc, site_z)
    roof_level.Name = "Roof Level"

    # all levels
    allLevels = FilteredElementCollector(doc).OfClass(Level).ToElements()

    # Create Bounding Box for each story level
    for ii in range(number_story):
        level_bbox_end_z = story_z[ii+1] if ii < (number_story-1) else site_z
        #print "Story"+str(ii)
        #print str(level_bbox_end_z)
        bb = BoundingBoxXYZ()
        bb.Min = XYZ(0, 0, story_z[ii])
        bb.Max = XYZ(site_x, site_y, level_bbox_end_z)
        bbox_story.append(bb.ToProtoType())

    ##############################################################################################################################
    ##############################################################################################################################
    # Create floorplan complexity
    ##############################################################################################################################
    ##############################################################################################################################

    LENGTH = site_x
    WIDTH = site_y
    print('x_length: ' + str(convert_to_meter(LENGTH)))
    print('y_width: ' + str(convert_to_meter(WIDTH)))
    z_level = ref_level.Elevation
    ceiling = allLevels[0].Elevation

    obstacle_counter = 0

    # DOOR_WIDTH_H = convert_meter_to_unit(0.5)
    DOOR_HEIGHT = convert_meter_to_unit(2.2)
    DOOR_THICKNESS_H = convert_meter_to_unit(0.25)

    # Create the exterior walls
    perimeter_lines = find_perimeter_lines(LENGTH, WIDTH, z_level)
    for ww in range(4):
        wall = Wall.Create(doc, perimeter_lines[ww], default_exterior_wall_type.Id, ref_level.Id, site_z, 0, False, True)
        exterior_wall_list.append(wall)

    # Create floor for each story level
    for ii in range(number_story):
        ll = allLevels[ii]
        floor_geometry = slab_geometry_by_level(LENGTH, WIDTH, ll, 0.0)
        floor = doc.Create.NewFloor(floor_geometry, default_floor_type, ll, True)
        floor_list.append(floor)

    # Create corridor lines

    MIN_ROOM_WIDTH = convert_meter_to_unit(4.)

    y_main_corridor = 0.5*WIDTH
    x_main_corridor_start = CORR_WIDTH
    x_main_corridor_end = LENGTH-CORR_WIDTH
    
    x_cross_start = x_main_corridor_start + 2*CORR_WIDTH
    x_cross_end = x_main_corridor_end - 2*CORR_WIDTH

    fractions_partitions = [1./NUM_ROOMS_PER_SIDE*i for i in range(NUM_ROOMS_PER_SIDE+1)] # if NUM_ROOMS_PER_SIDE > 1 else [0.5]
    x_pos_partitions = [x_cross_start + fr * (x_cross_end - x_cross_start) for fr in fractions_partitions]

    middle_lines_left = []
    middle_lines_right = []

    p2_l = XYZ(x_main_corridor_start, y_main_corridor+CORR_WIDTH/2., ceiling)
    p3_l = XYZ(x_main_corridor_end, y_main_corridor+CORR_WIDTH/2., ceiling)
    p2_r = XYZ(x_main_corridor_start, y_main_corridor-CORR_WIDTH/2., ceiling)
    p3_r = XYZ(x_main_corridor_end, y_main_corridor-CORR_WIDTH/2., ceiling)

    corridor_lines_left = [
        Autodesk.Revit.DB.Line.CreateBound(XYZ(0, y_main_corridor+CORR_WIDTH, ceiling), XYZ(x_main_corridor_start, y_main_corridor+CORR_WIDTH, ceiling)),
        Autodesk.Revit.DB.Line.CreateBound(XYZ(x_main_corridor_start, y_main_corridor+CORR_WIDTH, ceiling), p2_l),
        Autodesk.Revit.DB.Line.CreateBound(p2_l, p3_l),
        Autodesk.Revit.DB.Line.CreateBound(p3_l, XYZ(x_main_corridor_end, y_main_corridor+CORR_WIDTH, ceiling)),
        Autodesk.Revit.DB.Line.CreateBound(XYZ(x_main_corridor_end, y_main_corridor+CORR_WIDTH, ceiling), XYZ(LENGTH, y_main_corridor+CORR_WIDTH, ceiling)),
    ]

    corridor_lines_right = [
        Autodesk.Revit.DB.Line.CreateBound(XYZ(0, y_main_corridor-CORR_WIDTH, ceiling), XYZ(x_main_corridor_start, y_main_corridor-CORR_WIDTH, ceiling)),
        Autodesk.Revit.DB.Line.CreateBound(XYZ(x_main_corridor_start, y_main_corridor-CORR_WIDTH, ceiling), p2_r),
        Autodesk.Revit.DB.Line.CreateBound(p2_r, p3_r),
        Autodesk.Revit.DB.Line.CreateBound(p3_r, XYZ(x_main_corridor_end, y_main_corridor-CORR_WIDTH, ceiling)),
        Autodesk.Revit.DB.Line.CreateBound(XYZ(x_main_corridor_end, y_main_corridor-CORR_WIDTH, ceiling), XYZ(LENGTH, y_main_corridor-CORR_WIDTH, ceiling)),
    ]
    
    corridor_walls_left = [Wall.Create(doc, wall_l, default_interior_wall_type.Id, allLevels[0].Id, allLevels[1].Elevation - allLevels[0].Elevation, 0, False, True) 
        for wall_l in corridor_lines_left]
    corridor_walls_right = [Wall.Create(doc, wall_r, default_interior_wall_type.Id, allLevels[0].Id, allLevels[1].Elevation - allLevels[0].Elevation, 0, False, True) 
        for wall_r in corridor_lines_right]

    if INCLUDE_BOTTLENECK:
        bottleneck_lines = [
            Autodesk.Revit.DB.Line.CreateBound(p2_l, p2_r),
            Autodesk.Revit.DB.Line.CreateBound(p3_l, p3_r)
        ]
        bottleneck_walls = [Wall.Create(doc, b_wall, default_interior_wall_type.Id, allLevels[0].Id, allLevels[1].Elevation - allLevels[0].Elevation, 0, False, True) 
            for b_wall in bottleneck_lines]

        # some doors
        x_door_1 = x_main_corridor_start
        x_door_2 = x_main_corridor_end
        
        start_point_1 = XYZ(x_door_1-DOOR_THICKNESS_H, y_main_corridor-DOOR_WIDTH_H, z_level)
        end_point_1 = XYZ(x_door_1+DOOR_THICKNESS_H, y_main_corridor+DOOR_WIDTH_H, z_level+DOOR_HEIGHT)
        opening_1 = doc.Create.NewOpening(bottleneck_walls[0], start_point_1, end_point_1)

        start_point_2 = XYZ(x_door_2-DOOR_THICKNESS_H, y_main_corridor-DOOR_WIDTH_H, z_level)
        end_point_2 = XYZ(x_door_2+DOOR_THICKNESS_H, y_main_corridor+DOOR_WIDTH_H, z_level+DOOR_HEIGHT)
        opening_2 = doc.Create.NewOpening(bottleneck_walls[1], start_point_2, end_point_2)
    
    # destination areas
    room_x_min, room_x_max = 0, x_main_corridor_start
    room_y_min, room_y_max = y_main_corridor-CORR_WIDTH, y_main_corridor+CORR_WIDTH
    room_dict.update({
        'CROWDIT_DESTINATION_0': [
                (convert_to_meter(room_x_min)+0.5, convert_to_meter(room_y_min)+0.5),
                (convert_to_meter(room_x_max)-0.5, convert_to_meter(room_y_max)-0.5)
            ]
        }
    )

    room_x_min, room_x_max = x_main_corridor_end, LENGTH
    room_y_min, room_y_max = y_main_corridor-CORR_WIDTH, y_main_corridor+CORR_WIDTH
    room_dict.update({
        'CROWDIT_DESTINATION_1': [
                (convert_to_meter(room_x_min)+0.5, convert_to_meter(room_y_min)+0.5),
                (convert_to_meter(room_x_max)-0.5, convert_to_meter(room_y_max)-0.5)
            ]
        }
    )

    for idx, x_pos_part in enumerate(x_pos_partitions):

        middle_lines_left.append(
                Autodesk.Revit.DB.Line.CreateBound(XYZ(x_pos_part, y_main_corridor+CORR_WIDTH/2., ceiling), XYZ(x_pos_part, WIDTH, ceiling))
        )
        middle_lines_right.append(
            Autodesk.Revit.DB.Line.CreateBound(XYZ(x_pos_part, y_main_corridor-CORR_WIDTH/2., ceiling), XYZ(x_pos_part, 0, ceiling))
        )

        # some doors
        if idx < len(x_pos_partitions)-1:
            x_opening = (x_pos_partitions[idx]+x_pos_partitions[idx+1]) / 2.
            y_opening_l = y_main_corridor+CORR_WIDTH/2.
            y_opening_r = y_main_corridor-CORR_WIDTH/2.
            z_opening = z_level

            # left door
            start_point_l = XYZ(x_opening-DOOR_WIDTH_H, y_opening_l-DOOR_THICKNESS_H, z_opening)
            end_point_l = XYZ(x_opening+DOOR_WIDTH_H, y_opening_l+DOOR_THICKNESS_H, z_opening+DOOR_HEIGHT)
            opening_l = doc.Create.NewOpening(corridor_walls_left[2], start_point_l, end_point_l)

            # right door
            start_point_r = XYZ(x_opening-DOOR_WIDTH_H, y_opening_r-DOOR_THICKNESS_H, z_opening)
            end_point_r = XYZ(x_opening+DOOR_WIDTH_H, y_opening_r+DOOR_THICKNESS_H, z_opening+DOOR_HEIGHT)
            opening_r = doc.Create.NewOpening(corridor_walls_right[2], start_point_r, end_point_r)

            # assign areas
            room_x_min, room_x_max = min(x_pos_partitions[idx], x_pos_partitions[idx+1]), max(x_pos_partitions[idx], x_pos_partitions[idx+1])
            room_y_min1, room_y_max1 = 0, y_main_corridor-CORR_WIDTH/2.
            room_y_min2, room_y_max2 = y_main_corridor+CORR_WIDTH/2., WIDTH

            room_dict.update({
                'CROWDIT_ORIGIN_'+str(2*idx): [
                        (convert_to_meter(room_x_min)+0.5, convert_to_meter(room_y_min1)+0.5),
                        (convert_to_meter(room_x_max)-0.5, convert_to_meter(room_y_max1)-0.5)
                    ]
                }
            )

            room_dict.update({
                'CROWDIT_ORIGIN_'+str(1+2*idx): [
                        (convert_to_meter(room_x_min)+0.5, convert_to_meter(room_y_min2)+0.5),
                        (convert_to_meter(room_x_max)-0.5, convert_to_meter(room_y_max2)-0.5)
                    ]
                }
            )
        
        # obstacles
        obstacle_length = 2.

        x_obst_min, x_obst_max = convert_to_meter(x_pos_part)-obstacle_length/2., convert_to_meter(x_pos_part)+obstacle_length/2.
        y_obst_min = convert_to_meter(y_main_corridor+CORR_WIDTH/2.)-0.1-OBSTACLE_WIDTH if idx%2 == 0 else convert_to_meter(y_main_corridor-CORR_WIDTH/2.)+0.1
        y_obst_max = convert_to_meter(y_main_corridor+CORR_WIDTH/2.)-0.1 if idx%2 == 0 else convert_to_meter(y_main_corridor-CORR_WIDTH/2.)+0.1+OBSTACLE_WIDTH

        room_dict.update({
            'CROWDIT_OBSTACLE_'+str(obstacle_counter)+'_2_1_': [
                    (x_obst_min, y_obst_min),
                    (x_obst_max, y_obst_max)
                ]
            }
        )
        obstacle_counter += 1

    middle_walls_left = [Wall.Create(doc, wall_l, default_interior_wall_type.Id, allLevels[0].Id, allLevels[1].Elevation - allLevels[0].Elevation, 0, False, True) 
        for wall_l in middle_lines_left
    ]
    middle_walls_right = [Wall.Create(doc, wall_r, default_interior_wall_type.Id, allLevels[0].Id, allLevels[1].Elevation - allLevels[0].Elevation, 0, False, True) 
        for wall_r in middle_lines_right
    ]


#--------------------------------------------------------------
#------------------ OK NOW END THE CODE -----------------------
#--------------------------------------------------------------

TransactionManager.Instance.TransactionTaskDone()

###############################################################
# Prepare the output 
###############################################################
OUT = room_dict
# ----------------------------------------
E2EGeometryCreator = Python(IN[0]=default_exterior_wall_types, IN[1]=default_floor_types, IN[2]=default_interior_wall_types, IN[3]=parameterPreprocessor, IN[4]=door_width, IN[5]=obstacle_width, IN[6]=room_width, IN[7]=modelSelector)  # CPython3
# ---------- E2EGeometryCreator.python (551 lines) ----------
###############################################################
# Load the Libraries
###############################################################
import os
import clr
import sys
import math
import System

from System import Array
from System.Collections.Generic import *

clr.AddReference("RevitNodes")
import Revit

clr.ImportExtensions(Revit.Elements)
clr.ImportExtensions(Revit.GeometryConversion)

clr.AddReference("RevitServices")
import RevitServices
from RevitServices.Persistence import DocumentManager 
from RevitServices.Transactions import TransactionManager 

clr.AddReference("RevitAPI")
clr.AddReference("RevitAPIUI")

clr.AddReference('ProtoGeometry')
import Autodesk 
from Autodesk.DesignScript.Geometry import *
from Autodesk.Revit.DB import *
#from Autodesk.Revit.UI import *
from Autodesk.Revit.DB import StairsEditScope
from Autodesk.Revit.DB import Parameter
from Autodesk.Revit.DB.Architecture import StairsRun
from Autodesk.Revit.DB.Architecture import *
from Autodesk.Revit.DB import IFailuresPreprocessor

###############################################################
# Customize functions 
###############################################################
"""
Converts default unit in Dynamo into meter...
"""
def convert_meter_to_unit(pre_value):
    tempo_list = []
    tempo_value = 0
    if isinstance(pre_value, list):
        len_list = len(pre_value)
        for ii in range(len_list):
            tempo_list.append (float(UnitUtils.ConvertToInternalUnits(pre_value[ii], UnitTypeId.Meters)))
        pre_value = tempo_list
    else:
        tempo_value = float(UnitUtils.ConvertToInternalUnits(pre_value, UnitTypeId.Meters))
        pre_value = tempo_value
    return pre_value


def convert_to_meter(internal_value):
	if isinstance(internal_value, list):
		return [UnitUtils.ConvertFromInternalUnits(value, UnitTypeId.Meters) for value in internal_value]
	return float(UnitUtils.ConvertFromInternalUnits(internal_value, UnitTypeId.Meters))

"""
Provide perimeter lines from three dimensions...
"""
def find_perimeter_lines(x,y,z):
    line_list = []
    xx = x
    yy = y
    zz = z 
    # print "find_perimeter_lines x: " + str(x)
    # print "find_perimeter_lines y: " + str(y)
    # print "find_perimeter_lines z: " + str(z)
	
    line_1 = Autodesk.Revit.DB.Line.CreateBound(XYZ(0,0,zz),    XYZ(xx,0,zz))
    line_2 = Autodesk.Revit.DB.Line.CreateBound(XYZ(xx,0,zz),   XYZ(xx,yy,zz))
    line_3 = Autodesk.Revit.DB.Line.CreateBound(XYZ(xx,yy,zz),  XYZ(0,yy,zz))
    line_4 = Autodesk.Revit.DB.Line.CreateBound(XYZ(0,yy,zz),   XYZ(0,0,zz))

    line_list.append(line_1)
    line_list.append(line_2)
    line_list.append(line_3)
    line_list.append(line_4)
    
    return line_list

"""
Provide the geometry of slab by level...
"""
def slab_geometry_by_level(x,y,level,delta_z):
    zz = level.Elevation + delta_z
    xx = x
    yy = y 
    line_1 = Autodesk.Revit.DB.Line.CreateBound(XYZ(0,0,zz),    XYZ(xx,0,zz))
    line_2 = Autodesk.Revit.DB.Line.CreateBound(XYZ(xx,0,zz),   XYZ(xx,yy,zz))
    line_3 = Autodesk.Revit.DB.Line.CreateBound(XYZ(xx,yy,zz),  XYZ(0,yy,zz))
    line_4 = Autodesk.Revit.DB.Line.CreateBound(XYZ(0,yy,zz),   XYZ(0,0,zz))
    
    slab_geometry = CurveArray()
    slab_geometry.Append(line_1)
    slab_geometry.Append(line_2)
    slab_geometry.Append(line_3)
    slab_geometry.Append(line_4)
    return slab_geometry

###############################################################
# Current doc/app/ui
###############################################################
doc = DocumentManager.Instance.CurrentDBDocument
# uiapp = DocumentManager.Instance.CurrentUIApplication 
# app = uiapp.Application
# uidoc = uiapp.ActiveUIDocument

###############################################################
# Prepare the input
###############################################################
default_exterior_wall_type = UnwrapElement(IN[0])                   # Default exterior wall type
default_floor_type = UnwrapElement(IN[1])                           # Default Floor type
default_interior_wall_type = UnwrapElement(IN[2])				# Default interior wall type
### INPUT PARAMETERS ###
parameter_list = IN[3][1]
site_x = parameter_list[0]                                # the overall length of the site
site_y = parameter_list[1]                                # the overall widthness of the site
CORR_WIDTH = parameter_list[2] # convert_meter_to_unit(3)
NUM_ROOMS_SHORT_SIDE = parameter_list[3]
NUM_ROOMS_LONG_SIDE = parameter_list[4]
USE_BOTTLENECKS = parameter_list[5]

create_mode = IN[7][2]
DOOR_WIDTH_H = convert_meter_to_unit(float(IN[4])/2.)
OBSTACLE_WIDTH = float(IN[5])

number_story = 1                                          # the total amount of the stories;
story_z = [0]
site_z = 4                                              # the overall height of the site
ref_level_z = 0                                         # the z-position of the reference level (default level = level 0, created in the prepared .rvt)
###############################################################
# Transaction in Revit
###############################################################
TransactionManager.Instance.EnsureInTransaction(doc)
###############################################################
# Define the output
###############################################################

# Create room dict
room_dict = {}

if create_mode:
    geo_site = []                                                       # archive all the input data
    ref_level = []                                                      # the reference level
    bbox_site = []                                                      # bounding box of the site

    # sys.path.append('C:\Users\ga78jem\Miniconda3\envs\trajectron++\Lib\site-packages')

    ###############################################################
    # Convert the Units | b = UnitUtils.ConvertToInternalUnits(a, UnitTypeId.Meters)  b = a*3 | c = UnitUtils.ConvertFromInternalUnits(a, UnitTypeId.Meters)  c = a*3
    ###############################################################

    # print "site x before conversion:" + str(site_x)
    # adjust the sizes to account for wall thickness
    site_x -= 0.3
    site_y -= 0.3
    site_x = convert_meter_to_unit(site_x)
    site_y = convert_meter_to_unit(site_y)
    site_z = convert_meter_to_unit(site_z)
    ref_level_z = convert_meter_to_unit(ref_level_z)
    CORR_WIDTH = convert_meter_to_unit(CORR_WIDTH)
    # print "site x after conversion:" + str(site_x)

    ###############################################################
    # Delete all levels apart from the reference level (when there are multiple levels)
    ###############################################################
    # Collect all levels
    levelArray = (FilteredElementCollector(doc)
        .OfCategory(BuiltInCategory.OST_Levels)
        .WhereElementIsNotElementType()
        .ToElements())

    def clear_model(bool_value):
        if bool_value:
            del_grid = FilteredElementCollector(doc).OfCategory(BuiltInCategory.OST_Grids).WhereElementIsNotElementType().ToElements()
            del_door = FilteredElementCollector(doc).OfCategory(BuiltInCategory.OST_Doors).WhereElementIsNotElementType().ToElements()
            del_floor = FilteredElementCollector(doc).OfCategory(BuiltInCategory.OST_Floors).WhereElementIsNotElementType().ToElements()
            del_wall = FilteredElementCollector(doc).OfCategory(BuiltInCategory.OST_Walls).WhereElementIsNotElementType().ToElements()
            del_roof = FilteredElementCollector(doc).OfCategory(BuiltInCategory.OST_Roofs).WhereElementIsNotElementType().ToElements()
            del_all = [del_grid, del_door, del_floor, del_wall, del_roof]
            for element_type in del_all:
                for element in element_type:
                    doc.Delete(element.Id)

    clear_model(True)

    # Check the number of the existing levels, if multiple, delete and save only one
    if len(levelArray) > 1:
        #print "levelArray.Count > 1, from 01_Site"
        for levelElement in levelArray:
            if levelElement.Elevation != ref_level_z:
                doc.Delete(levelElement.Id)
    ref_level = levelArray[0]
    ref_level.Name = "Story Level 0"

    # Check the if the saved one is the reference level, correct it if not
    if ref_level.Elevation != ref_level_z:
        ref_level_new = Autodesk.Revit.DB.Level.Create(doc, ref_level_z)
        doc.Delete(ref_level.Id)
        ref_level = ref_level_new
        ref_level.Name = "Story Level 0"

    #--------------------------------------------------------------
    #------------------ OK NOW YOU CAN CODE -----------------------
    #--------------------------------------------------------------

    # Create Bounding Box
    bb = BoundingBoxXYZ()
    bb.Min = XYZ(0, 0, 0)
    bb.Max = XYZ(0, 0, site_z)
    bbox_site.append(bb.ToProtoType())                  # the bounding box of the entire site
    # Close and save the recording file
    # geo_site.append(site_x)
    # geo_site.append(site_y)
    # geo_site.append(site_z)

    ###############################################################
    # END OF SCRIPT 1
    # START OF SCRIPT 2
    ###############################################################

    archive_data = []                                                   # archive all the input data
    bbox_story = []
    exterior_wall_list = []
    floor_list = []
    roof_list = []
    entrance_door_list = []

    ###############################################################
    # Convert the Units | b = UnitUtils.ConvertToInternalUnits(a, UnitTypeId.Meters)  b = a*3 | c = UnitUtils.ConvertFromInternalUnits(a, UnitTypeId.Meters)  c = a*3
    ###############################################################
    story_z = convert_meter_to_unit(story_z)

    # Collect all levels
    levelArray = (FilteredElementCollector(doc)
        .OfCategory(BuiltInCategory.OST_Levels)
        .WhereElementIsNotElementType()
        .ToElements())

    # Check the number of the existing levels, if multiple, delete and save only one
    if len(levelArray) > 1:
        #print "levelArray.Count > 1, from 02_Story"
        for levelElement in levelArray:
            if levelElement.Elevation != ref_level.Elevation:
                doc.Delete(levelElement.Id)
    ref_level = levelArray[0]
    ref_level.Name = "Story Level 0"

    # Check the if the saved one is the reference level, correct it if not
    if ref_level.Elevation != 0:
        ref_level_new = Autodesk.Revit.DB.Level.Create(doc, 0)
        doc.Delete(ref_level.Id)
        ref_level = ref_level_new
        ref_level.Name = "Story Level 0"

    ###############################################################
    # Check the consistence with the bouning box of the side 
    ###############################################################
    # Check the z-position of the highest story against the site box

    check_site_story = True if max(story_z) < site_z else False
    #print "The stories are consistent with the overal site:" + str(check_site_story)

    # Create new story levels
    for ii in range(number_story):
        if ref_level.Elevation == story_z[ii]:
            continue
        new_level = Autodesk.Revit.DB.Level.Create(doc, story_z[ii])
        new_level.Name = "Story Level " + str(ii)

    # Create the roof level
    roof_level = Autodesk.Revit.DB.Level.Create(doc, site_z)
    roof_level.Name = "Roof Level"

    # all levels
    allLevels = FilteredElementCollector(doc).OfClass(Level).ToElements()

    # Create Bounding Box for each story level
    for ii in range(number_story):
        level_bbox_end_z = story_z[ii+1] if ii < (number_story-1) else site_z
        #print "Story"+str(ii)
        #print str(level_bbox_end_z)
        bb = BoundingBoxXYZ()
        bb.Min = XYZ(0, 0, story_z[ii])
        bb.Max = XYZ(site_x, site_y, level_bbox_end_z)
        bbox_story.append(bb.ToProtoType())

    ##############################################################################################################################
    ##############################################################################################################################
    # Create floorplan complexity
    ##############################################################################################################################
    ##############################################################################################################################

    WIDTH = site_y
    LENGTH = site_x
    print('x_length: ' + str(convert_to_meter(LENGTH)))
    print('y_width: ' + str(convert_to_meter(WIDTH)))
    print("")
    z_level = ref_level.Elevation
    ceiling = allLevels[0].Elevation

    obstacle_counter = 0

    # Create the exterior walls
    perimeter_lines = find_perimeter_lines(LENGTH, WIDTH, z_level)
    for ww in range(4):
        wall = Wall.Create(doc, perimeter_lines[ww], default_exterior_wall_type.Id, ref_level.Id, site_z, 0, False, True)
        exterior_wall_list.append(wall)

    # Create floor for each story level
    for ii in range(number_story):
        ll = allLevels[ii]
        floor_geometry = slab_geometry_by_level(LENGTH, WIDTH, ll, 0.0)
        floor = doc.Create.NewFloor(floor_geometry, default_floor_type, ll, True)
        floor_list.append(floor)

    # Create corridor lines
    y_main_corridor = 0.5*WIDTH
    x_main_corridor_start = 1.5*CORR_WIDTH
    x_main_corridor_end = LENGTH-1.5*CORR_WIDTH
        
    bottlneck_ys = [CORR_WIDTH, WIDTH-CORR_WIDTH]

    P0_long = XYZ(x_main_corridor_start, 0, ceiling)
    P1_long = XYZ(x_main_corridor_start, y_main_corridor - CORR_WIDTH/2., ceiling)
    P2_long = XYZ(LENGTH, y_main_corridor - CORR_WIDTH/2., ceiling)

    line_corr_0_long = Autodesk.Revit.DB.Line.CreateBound(P0_long, P1_long)
    line_corr_1_long = Autodesk.Revit.DB.Line.CreateBound(P1_long, P2_long)

    P1_short = XYZ(0, y_main_corridor + CORR_WIDTH/2., ceiling)
    P2_short = XYZ(x_main_corridor_end, y_main_corridor + CORR_WIDTH/2., ceiling)
    P3_short = XYZ(x_main_corridor_end, WIDTH, ceiling)
    
    line_corr_1_short = Autodesk.Revit.DB.Line.CreateBound(P1_short, P2_short)
    line_corr_2_short = Autodesk.Revit.DB.Line.CreateBound(P2_short, P3_short)

    corr_room_lines = [line_corr_1_short, line_corr_2_short, line_corr_0_long, line_corr_1_long] # , line_corr_2_long, line_corr_3_long]
    # Create corridor-room walls
    corr_walls = [Wall.Create(doc, wall_line, default_interior_wall_type.Id, allLevels[0].Id, allLevels[1].Elevation - allLevels[0].Elevation, 0, False, True) \
        for wall_line in corr_room_lines]

    # obstacles
    obstacle_length = 1.

    x_obst_min, x_obst_max = convert_to_meter(x_main_corridor_end)+0.1, convert_to_meter(x_main_corridor_end)+0.1+obstacle_length
    y_obst_min, y_obst_max = convert_to_meter(y_main_corridor + CORR_WIDTH/2.)+0.5, convert_to_meter(y_main_corridor + CORR_WIDTH/2.)+0.5+OBSTACLE_WIDTH
    room_dict.update({
        'CROWDIT_OBSTACLE_'+str(obstacle_counter)+'_1_1_': [
                (x_obst_min, y_obst_min),
                (x_obst_max, y_obst_max)
            ]
        }
    )
    obstacle_counter += 1

    x_obst_min, x_obst_max = convert_to_meter(x_main_corridor_start)-0.1-obstacle_length, convert_to_meter(x_main_corridor_start)-0.1
    y_obst_min, y_obst_max = convert_to_meter(y_main_corridor - CORR_WIDTH/2.)-0.5-OBSTACLE_WIDTH, convert_to_meter(y_main_corridor - CORR_WIDTH/2.)-0.5
    room_dict.update({
        'CROWDIT_OBSTACLE_'+str(obstacle_counter)+'_1_1_': [
                (x_obst_min, y_obst_min),
                (x_obst_max, y_obst_max)
            ]
        }
    )
    obstacle_counter += 1
    

    # destination areas
    bottlneck_ys_room_dict = [0, WIDTH]
    origin_opening_list = []
    
    x_min_fixed_1, x_max_fixed_1 = min(0, x_main_corridor_start), max(0, x_main_corridor_start)
    y_min_fixed_1, y_max_fixed_1 = min(bottlneck_ys[0], bottlneck_ys_room_dict[0]), max(bottlneck_ys[0], bottlneck_ys_room_dict[0])

    room_dict.update({
        'CROWDIT_DESTINATION_0': [
                (convert_to_meter(x_min_fixed_1)+0.5, convert_to_meter(y_min_fixed_1)+0.5),
                (convert_to_meter(x_max_fixed_1)-0.5, convert_to_meter(y_max_fixed_1)-0.5)
            ]
        }
    )

    x_min_fixed_2, x_max_fixed_2 = min(x_main_corridor_end, LENGTH), max(x_main_corridor_end, LENGTH)
    y_min_fixed_2, y_max_fixed_2 = min(bottlneck_ys[1], bottlneck_ys_room_dict[1]), max(bottlneck_ys[1], bottlneck_ys_room_dict[1])

    room_dict.update({
        'CROWDIT_DESTINATION_1': [
                (convert_to_meter(x_min_fixed_2)+0.5, convert_to_meter(y_min_fixed_2)+0.5),
                (convert_to_meter(x_max_fixed_2)-0.5, convert_to_meter(y_max_fixed_2)-0.5)
            ]
        }
    )

    ###############
    # Office rooms
    ###############
    # DOOR_WIDTH_H = convert_meter_to_unit(0.5)
    DOOR_HEIGHT = convert_meter_to_unit(2.2)
    DOOR_THICKNESS_H = convert_meter_to_unit(0.25)

    # short side
    fractions = [1./(NUM_ROOMS_SHORT_SIDE)*i for i in range(NUM_ROOMS_SHORT_SIDE+1)]
    short_x_coord_list = [P1_short[0] + fr * (P2_short[0] - P1_short[0]) for fr in fractions]
    
    for x_coord in short_x_coord_list[1:-1]:
        office_office_line = Autodesk.Revit.DB.Line.CreateBound(
                XYZ(x_coord, P2_short[1], ceiling),
                XYZ(x_coord, P3_short[1], ceiling))
        Wall.Create(doc, office_office_line, default_interior_wall_type.Id, allLevels[0].Id, allLevels[1].Elevation - allLevels[0].Elevation, 0, False, True)
    
    # create openings short offices
    for id in range(len(short_x_coord_list)-1):
        x_opening = (short_x_coord_list[id+1] + short_x_coord_list[id])/2.
        y_opening = P1_short[1]
        z_opening = z_level

        start_point = XYZ(x_opening-DOOR_WIDTH_H, y_opening-DOOR_THICKNESS_H, z_opening)
        end_point = XYZ(x_opening+DOOR_WIDTH_H, y_opening+DOOR_THICKNESS_H, z_opening+DOOR_HEIGHT)
        origin_opening_list.append(doc.Create.NewOpening(corr_walls[0], start_point, end_point))

        y_min_var_short, y_max_var_short = min(P1_short[1], P3_short[1]), max(P1_short[1], P3_short[1])

        room_dict.update({
            'CROWDIT_ORIGIN_'+str(id): [
                    (convert_to_meter(short_x_coord_list[id])+0.5, convert_to_meter(y_min_var_short)+0.5),
                    (convert_to_meter(short_x_coord_list[id+1])-0.5, convert_to_meter(y_max_var_short)-0.5)
                ]
            }
        )

        if id > 0:
            # obstacle: rectangle (e.g. table: 2x1 m rectangle)
            obstacle_length = 2.
            if y_opening < y_main_corridor:
                y_obst_min = convert_to_meter(y_opening)+0.1
                y_obst_max = convert_to_meter(y_opening)+0.1+OBSTACLE_WIDTH
            else:
                y_obst_min = convert_to_meter(y_opening)-0.1-OBSTACLE_WIDTH
                y_obst_max = convert_to_meter(y_opening)-0.1

            room_dict.update({
                'CROWDIT_OBSTACLE_'+str(obstacle_counter)+'_2_1_': [
                        (convert_to_meter(short_x_coord_list[id])-obstacle_length/2., y_obst_min),
                        (convert_to_meter(short_x_coord_list[id])+obstacle_length/2., y_obst_max)
                    ]
                }
            )
            obstacle_counter += 1


    # long side
    # create openings long offices
    fractions = [1./(NUM_ROOMS_LONG_SIDE)*i for i in range(NUM_ROOMS_LONG_SIDE+1)]
    long_x_coord_list = [P1_long[0] + fr * (P2_long[0] - P1_long[0]) for fr in fractions]

    for x_coord in long_x_coord_list[1:-1]:
        office_office_line = Autodesk.Revit.DB.Line.CreateBound(
                XYZ(x_coord, P2_long[1], ceiling),
                XYZ(x_coord, P0_long[1], ceiling))
        Wall.Create(doc, office_office_line, default_interior_wall_type.Id, allLevels[0].Id, allLevels[1].Elevation - allLevels[0].Elevation, 0, False, True)

    
    # create openings long offices
    for id in range(len(long_x_coord_list[:-1])):
        x_opening = (long_x_coord_list[id+1] + long_x_coord_list[id])/2.
        y_opening = P1_long[1]
        z_opening = z_level

        start_point = XYZ(x_opening-DOOR_WIDTH_H, y_opening-DOOR_THICKNESS_H, z_opening)
        end_point = XYZ(x_opening+DOOR_WIDTH_H, y_opening+DOOR_THICKNESS_H, z_opening+DOOR_HEIGHT)
        origin_opening_list.append(doc.Create.NewOpening(corr_walls[3], start_point, end_point))

        y_min_var_long, y_max_var_long = min(P0_long[1], P1_long[1]), max(P0_long[1], P1_long[1])
        room_dict.update({
            'CROWDIT_ORIGIN_'+str(id+len(short_x_coord_list)-1): [
                    (convert_to_meter(long_x_coord_list[id])+0.5, convert_to_meter(y_min_var_long)+0.5),
                    (convert_to_meter(long_x_coord_list[id+1])-0.5, convert_to_meter(y_max_var_long)-0.5)
                ]
            }
        )

        if id > 0:
            # obstacle: rectangle (e.g. table: 2x1 m rectangle)
            obstacle_length = 2.
            if y_opening < y_main_corridor:
                y_obst_min = convert_to_meter(y_opening)+0.1
                y_obst_max = convert_to_meter(y_opening)+0.1+OBSTACLE_WIDTH
            else:
                y_obst_min = convert_to_meter(y_opening)-0.1-OBSTACLE_WIDTH
                y_obst_max = convert_to_meter(y_opening)-0.1

            room_dict.update({
                'CROWDIT_OBSTACLE_'+str(obstacle_counter)+'_2_1_': [
                        (convert_to_meter(long_x_coord_list[id])-obstacle_length/2., y_obst_min),
                        (convert_to_meter(long_x_coord_list[id])+obstacle_length/2., y_obst_max)
                    ]
                }
            )
            obstacle_counter += 1


    if USE_BOTTLENECKS:
        bottleneck_lines = [
            Autodesk.Revit.DB.Line.CreateBound(
                XYZ(0, bottlneck_ys[0], ceiling),
                XYZ(x_main_corridor_start, bottlneck_ys[0], ceiling)),
            
            Autodesk.Revit.DB.Line.CreateBound(
                XYZ(x_main_corridor_end, bottlneck_ys[1], ceiling),
                XYZ(LENGTH, bottlneck_ys[1], ceiling))
        ]
        
        bottleneck_walls = [Wall.Create(doc, line, default_interior_wall_type.Id, allLevels[0].Id, allLevels[1].Elevation - allLevels[0].Elevation, 0, False, True)
            for line in bottleneck_lines]

        # some doors
        x_opening_1 = x_main_corridor_start/2.
        y_opening_1 = bottlneck_ys[0]
        z_opening_1 = z_level

        start_point_1 = XYZ(x_opening_1-DOOR_WIDTH_H, y_opening_1-DOOR_THICKNESS_H, z_opening_1)
        end_point_1 = XYZ(x_opening_1+DOOR_WIDTH_H, y_opening_1+DOOR_THICKNESS_H, z_opening+DOOR_HEIGHT)
        opening_1 = doc.Create.NewOpening(bottleneck_walls[0], start_point_1, end_point_1)

        x_opening_2 = x_main_corridor_end + (LENGTH-x_main_corridor_end)/2.
        y_opening_2 = bottlneck_ys[1]
        z_opening_2 = z_level

        start_point_2 = XYZ(x_opening_2-DOOR_WIDTH_H, y_opening_2-DOOR_THICKNESS_H, z_opening_2)
        end_point_2 = XYZ(x_opening_2+DOOR_WIDTH_H, y_opening_2+DOOR_THICKNESS_H, z_opening_2+DOOR_HEIGHT)
        opening_2 = doc.Create.NewOpening(bottleneck_walls[1], start_point_2, end_point_2)

    assert len(origin_opening_list) == len([key for key in room_dict if key.startswith('CROWDIT_ORIGIN_')])
    
#--------------------------------------------------------------
#------------------ OK NOW END THE CODE -----------------------
#--------------------------------------------------------------

TransactionManager.Instance.TransactionTaskDone()

###############################################################
# Prepare the output 
###############################################################
OUT = room_dict # , len([key for key in room_dict if key.startswith('CROWDIT_OBSTACLE_')])
# ----------------------------------------
edgeGeometryCreator = Python(IN[0]=default_exterior_wall_types, IN[1]=default_floor_types, IN[2]=default_interior_wall_types, IN[3]=parameterPreprocessor, IN[4]=door_width, IN[5]=obstacle_width, IN[6]=room_width, IN[7]=modelSelector)  # CPython3
# ---------- edgeGeometryCreator.python (615 lines) ----------
###############################################################
# Load the Libraries -> 5,6,7 = door obstacle room widths
###############################################################
import os
import clr
import sys
import math
import System

from System import Array
from System.Collections.Generic import *

clr.AddReference("RevitNodes")
import Revit

clr.ImportExtensions(Revit.Elements)
clr.ImportExtensions(Revit.GeometryConversion)

clr.AddReference("RevitServices")
import RevitServices
from RevitServices.Persistence import DocumentManager 
from RevitServices.Transactions import TransactionManager 

clr.AddReference("RevitAPI")
clr.AddReference("RevitAPIUI")

clr.AddReference('ProtoGeometry')
import Autodesk 
from Autodesk.DesignScript.Geometry import *
from Autodesk.Revit.DB import *
#from Autodesk.Revit.UI import *
from Autodesk.Revit.DB import StairsEditScope
from Autodesk.Revit.DB import Parameter
from Autodesk.Revit.DB.Architecture import StairsRun
from Autodesk.Revit.DB.Architecture import *
from Autodesk.Revit.DB import IFailuresPreprocessor

###############################################################
# Customize functions 
###############################################################
"""
Converts default unit in Dynamo into meter...
"""
def convert_meter_to_unit(pre_value):
    tempo_list = []
    tempo_value = 0
    if isinstance(pre_value, list):
        len_list = len(pre_value)
        for ii in range(len_list):
            tempo_list.append (float(UnitUtils.ConvertToInternalUnits(pre_value[ii], UnitTypeId.Meters)))
        pre_value = tempo_list
    else:
        tempo_value = float(UnitUtils.ConvertToInternalUnits(pre_value, UnitTypeId.Meters))
        pre_value = tempo_value
    return pre_value


def convert_to_meter(internal_value):
	if isinstance(internal_value, list):
		return [UnitUtils.ConvertFromInternalUnits(value, UnitTypeId.Meters) for value in internal_value]
	return float(UnitUtils.ConvertFromInternalUnits(internal_value, UnitTypeId.Meters))

"""
Provide perimeter lines from three dimensions...
"""
def find_perimeter_lines(x,y,z):
    line_list = []
    xx = x
    yy = y
    zz = z 
    # print "find_perimeter_lines x: " + str(x)
    # print "find_perimeter_lines y: " + str(y)
    # print "find_perimeter_lines z: " + str(z)
	
    line_1 = Autodesk.Revit.DB.Line.CreateBound(XYZ(0,0,zz),    XYZ(xx,0,zz))
    line_2 = Autodesk.Revit.DB.Line.CreateBound(XYZ(xx,0,zz),   XYZ(xx,yy,zz))
    line_3 = Autodesk.Revit.DB.Line.CreateBound(XYZ(xx,yy,zz),  XYZ(0,yy,zz))
    line_4 = Autodesk.Revit.DB.Line.CreateBound(XYZ(0,yy,zz),   XYZ(0,0,zz))

    line_list.append(line_1)
    line_list.append(line_2)
    line_list.append(line_3)
    line_list.append(line_4)
    
    return line_list

"""
Provide the geometry of slab by level...
"""
def slab_geometry_by_level(x,y,level,delta_z):
    zz = level.Elevation + delta_z
    xx = x
    yy = y 
    line_1 = Autodesk.Revit.DB.Line.CreateBound(XYZ(0,0,zz),    XYZ(xx,0,zz))
    line_2 = Autodesk.Revit.DB.Line.CreateBound(XYZ(xx,0,zz),   XYZ(xx,yy,zz))
    line_3 = Autodesk.Revit.DB.Line.CreateBound(XYZ(xx,yy,zz),  XYZ(0,yy,zz))
    line_4 = Autodesk.Revit.DB.Line.CreateBound(XYZ(0,yy,zz),   XYZ(0,0,zz))
    
    slab_geometry = CurveArray()
    slab_geometry.Append(line_1)
    slab_geometry.Append(line_2)
    slab_geometry.Append(line_3)
    slab_geometry.Append(line_4)
    return slab_geometry

###############################################################
# Current doc/app/ui
###############################################################
doc = DocumentManager.Instance.CurrentDBDocument
# uiapp = DocumentManager.Instance.CurrentUIApplication 
# app = uiapp.Application
# uidoc = uiapp.ActiveUIDocument

###############################################################
# Prepare the input
###############################################################
default_exterior_wall_type = UnwrapElement(IN[0])                   # Default exterior wall type
default_floor_type = UnwrapElement(IN[1])                           # Default Floor type
default_interior_wall_type = UnwrapElement(IN[2])				# Default interior wall type
### INPUT PARAMETERS ###
parameter_list = IN[3][1]
site_x = parameter_list[0]                                # the overall length of the site
site_y = parameter_list[1]                                # the overall widthness of the site
CORR_WIDTH = parameter_list[2]
MIN_ROOM_LENGTH = parameter_list[3]
INCLUDE_BOTTLENECK = parameter_list[4]
create_mode = IN[7][3]
DOOR_WIDTH_H = convert_meter_to_unit(float(IN[4])/2.)
OBSTACLE_WIDTH  = float(IN[5])
ROOM_WIDTH = convert_meter_to_unit(float(IN[6]))

number_story = 1                                          # the total amount of the stories;
story_z = [0]
site_z = 4                                              # the overall height of the site
ref_level_z = 0                                         # the z-position of the reference level (default level = level 0, created in the prepared .rvt)
###############################################################
# Transaction in Revit
###############################################################
TransactionManager.Instance.EnsureInTransaction(doc)
###############################################################
# Define the output
###############################################################

# Create room dict
room_dict = {}

if create_mode:
    geo_site = []                                                       # archive all the input data
    ref_level = []                                                      # the reference level
    bbox_site = []                                                      # bounding box of the site

    # sys.path.append('C:\Users\ga78jem\Miniconda3\envs\trajectron++\Lib\site-packages')

    ###############################################################
    # Convert the Units | b = UnitUtils.ConvertToInternalUnits(a, UnitTypeId.Meters)  b = a*3 | c = UnitUtils.ConvertFromInternalUnits(a, UnitTypeId.Meters)  c = a*3
    ###############################################################

    # print "site x before conversion:" + str(site_x)
    # adjust the sizes to account for wall thickness
    site_x -= 0.3
    site_y -= 0.3
    site_x = convert_meter_to_unit(site_x)
    site_y = convert_meter_to_unit(site_y)
    site_z = convert_meter_to_unit(site_z)
    ref_level_z = convert_meter_to_unit(ref_level_z)
    CORR_WIDTH = convert_meter_to_unit(CORR_WIDTH)
    MIN_ROOM_LENGTH = convert_meter_to_unit(MIN_ROOM_LENGTH)
    
    # print "site x after conversion:" + str(site_x)

    ###############################################################
    # Delete all levels apart from the reference level (when there are multiple levels)
    ###############################################################
    # Collect all levels
    levelArray = (FilteredElementCollector(doc)
        .OfCategory(BuiltInCategory.OST_Levels)
        .WhereElementIsNotElementType()
        .ToElements())

    def clear_model(bool_value):
        if bool_value:
            del_grid = FilteredElementCollector(doc).OfCategory(BuiltInCategory.OST_Grids).WhereElementIsNotElementType().ToElements()
            del_door = FilteredElementCollector(doc).OfCategory(BuiltInCategory.OST_Doors).WhereElementIsNotElementType().ToElements()
            del_floor = FilteredElementCollector(doc).OfCategory(BuiltInCategory.OST_Floors).WhereElementIsNotElementType().ToElements()
            del_wall = FilteredElementCollector(doc).OfCategory(BuiltInCategory.OST_Walls).WhereElementIsNotElementType().ToElements()
            del_roof = FilteredElementCollector(doc).OfCategory(BuiltInCategory.OST_Roofs).WhereElementIsNotElementType().ToElements()
            del_all = [del_grid, del_door, del_floor, del_wall, del_roof]
            for element_type in del_all:
                for element in element_type:
                    doc.Delete(element.Id)

    clear_model(True)

    # Check the number of the existing levels, if multiple, delete and save only one
    if len(levelArray) > 1:
        #print "levelArray.Count > 1, from 01_Site"
        for levelElement in levelArray:
            if levelElement.Elevation != ref_level_z:
                doc.Delete(levelElement.Id)
    ref_level = levelArray[0]
    ref_level.Name = "Story Level 0"

    # Check the if the saved one is the reference level, correct it if not
    if ref_level.Elevation != ref_level_z:
        ref_level_new = Autodesk.Revit.DB.Level.Create(doc, ref_level_z)
        doc.Delete(ref_level.Id)
        ref_level = ref_level_new
        ref_level.Name = "Story Level 0"

    #--------------------------------------------------------------
    #------------------ OK NOW YOU CAN CODE -----------------------
    #--------------------------------------------------------------

    # Create Bounding Box
    bb = BoundingBoxXYZ()
    bb.Min = XYZ(0, 0, 0)
    bb.Max = XYZ(0, 0, site_z)
    bbox_site.append(bb.ToProtoType())                  # the bounding box of the entire site
    # Close and save the recording file
    # geo_site.append(site_x)
    # geo_site.append(site_y)
    # geo_site.append(site_z)

    ###############################################################
    # END OF SCRIPT 1
    # START OF SCRIPT 2
    ###############################################################

    archive_data = []                                                   # archive all the input data
    bbox_story = []
    exterior_wall_list = []
    floor_list = []
    roof_list = []
    entrance_door_list = []

    ###############################################################
    # Convert the Units | b = UnitUtils.ConvertToInternalUnits(a, UnitTypeId.Meters)  b = a*3 | c = UnitUtils.ConvertFromInternalUnits(a, UnitTypeId.Meters)  c = a*3
    ###############################################################
    story_z = convert_meter_to_unit(story_z)

    # Collect all levels
    levelArray = (FilteredElementCollector(doc)
        .OfCategory(BuiltInCategory.OST_Levels)
        .WhereElementIsNotElementType()
        .ToElements())

    # Check the number of the existing levels, if multiple, delete and save only one
    if len(levelArray) > 1:
        #print "levelArray.Count > 1, from 02_Story"
        for levelElement in levelArray:
            if levelElement.Elevation != ref_level.Elevation:
                doc.Delete(levelElement.Id)
    ref_level = levelArray[0]
    ref_level.Name = "Story Level 0"

    # Check the if the saved one is the reference level, correct it if not
    if ref_level.Elevation != 0:
        ref_level_new = Autodesk.Revit.DB.Level.Create(doc, 0)
        doc.Delete(ref_level.Id)
        ref_level = ref_level_new
        ref_level.Name = "Story Level 0"

    ###############################################################
    # Check the consistence with the bouning box of the side 
    ###############################################################
    # Check the z-position of the highest story against the site box

    check_site_story = True if max(story_z) < site_z else False
    #print "The stories are consistent with the overal site:" + str(check_site_story)

    # Create new story levels
    for ii in range(number_story):
        if ref_level.Elevation == story_z[ii]:
            continue
        new_level = Autodesk.Revit.DB.Level.Create(doc, story_z[ii])
        new_level.Name = "Story Level " + str(ii)

    # Create the roof level
    roof_level = Autodesk.Revit.DB.Level.Create(doc, site_z)
    roof_level.Name = "Roof Level"

    # all levels
    allLevels = FilteredElementCollector(doc).OfClass(Level).ToElements()

    # Create Bounding Box for each story level
    for ii in range(number_story):
        level_bbox_end_z = story_z[ii+1] if ii < (number_story-1) else site_z
        #print "Story"+str(ii)
        #print str(level_bbox_end_z)
        bb = BoundingBoxXYZ()
        bb.Min = XYZ(0, 0, story_z[ii])
        bb.Max = XYZ(site_x, site_y, level_bbox_end_z)
        bbox_story.append(bb.ToProtoType())

    ##############################################################################################################################
    ##############################################################################################################################
    # Create floorplan complexity
    ##############################################################################################################################
    ##############################################################################################################################

    LENGTH = site_x
    WIDTH = site_y
    print('x_length: ' + str(convert_to_meter(LENGTH)))
    print('y_width: ' + str(convert_to_meter(WIDTH)))
    z_level = ref_level.Elevation
    ceiling = allLevels[0].Elevation

    DOOR_HEIGHT = convert_meter_to_unit(2.2)
    DOOR_THICKNESS_H = convert_meter_to_unit(0.25)

    obstacle_counter = 0

    # Create the exterior walls
    perimeter_lines = find_perimeter_lines(LENGTH, WIDTH, z_level)
    for ww in range(4):
        wall = Wall.Create(doc, perimeter_lines[ww], default_exterior_wall_type.Id, ref_level.Id, site_z, 0, False, True)
        exterior_wall_list.append(wall)

    # Create floor for each story level
    for ii in range(number_story):
        ll = allLevels[ii]
        floor_geometry = slab_geometry_by_level(LENGTH, WIDTH, ll, 0.0)
        floor = doc.Create.NewFloor(floor_geometry, default_floor_type, ll, True)
        floor_list.append(floor)

    # Create corridor lines

    x_corridor = ROOM_WIDTH + CORR_WIDTH/2.
    y_corridor = WIDTH - ROOM_WIDTH - CORR_WIDTH/2.

    y_main_corridor = 0.5*WIDTH
    x_main_corridor_start = CORR_WIDTH
    x_main_corridor_end = LENGTH-CORR_WIDTH

    p2_l = XYZ(x_corridor-CORR_WIDTH/2., CORR_WIDTH, ceiling)
    p4_l = XYZ(LENGTH-CORR_WIDTH, y_corridor+CORR_WIDTH/2., ceiling)
    p2_r = XYZ(x_corridor+CORR_WIDTH/2., CORR_WIDTH, ceiling)
    p4_r = XYZ(LENGTH-CORR_WIDTH, y_corridor-CORR_WIDTH/2., ceiling)

    corridor_lines_left = [
        Autodesk.Revit.DB.Line.CreateBound(XYZ(x_corridor-CORR_WIDTH, 0, ceiling), XYZ(x_corridor-CORR_WIDTH, CORR_WIDTH, ceiling)),
        Autodesk.Revit.DB.Line.CreateBound(XYZ(x_corridor-CORR_WIDTH, CORR_WIDTH, ceiling), p2_l),
        Autodesk.Revit.DB.Line.CreateBound(p2_l, XYZ(x_corridor-CORR_WIDTH/2., y_corridor+CORR_WIDTH/2., ceiling)),
        Autodesk.Revit.DB.Line.CreateBound(XYZ(x_corridor-CORR_WIDTH/2., y_corridor+CORR_WIDTH/2., ceiling), p4_l),
        Autodesk.Revit.DB.Line.CreateBound(p4_l, XYZ(LENGTH-CORR_WIDTH, y_corridor+CORR_WIDTH, ceiling)),
        Autodesk.Revit.DB.Line.CreateBound(XYZ(LENGTH-CORR_WIDTH, y_corridor+CORR_WIDTH, ceiling), XYZ(LENGTH, y_corridor+CORR_WIDTH, ceiling)),
    ]

    corridor_lines_right = [
        Autodesk.Revit.DB.Line.CreateBound(XYZ(x_corridor+CORR_WIDTH, 0, ceiling), XYZ(x_corridor+CORR_WIDTH, CORR_WIDTH, ceiling)),
        Autodesk.Revit.DB.Line.CreateBound(XYZ(x_corridor+CORR_WIDTH, CORR_WIDTH, ceiling), p2_r),
        Autodesk.Revit.DB.Line.CreateBound(XYZ(x_corridor+CORR_WIDTH/2., CORR_WIDTH, ceiling), XYZ(x_corridor+CORR_WIDTH/2., y_corridor-CORR_WIDTH/2., ceiling)),
        Autodesk.Revit.DB.Line.CreateBound(XYZ(x_corridor+CORR_WIDTH/2., y_corridor-CORR_WIDTH/2., ceiling), p4_r),
        Autodesk.Revit.DB.Line.CreateBound(p4_r, XYZ(LENGTH-CORR_WIDTH, y_corridor-CORR_WIDTH, ceiling)),
        Autodesk.Revit.DB.Line.CreateBound(XYZ(LENGTH-CORR_WIDTH, y_corridor-CORR_WIDTH, ceiling), XYZ(LENGTH, y_corridor-CORR_WIDTH, ceiling)),
    ]

    # assign room
    room_dict.update({
        'CROWDIT_DESTINATION_'+str(0): [
                (convert_to_meter(x_corridor-CORR_WIDTH)+0.5, convert_to_meter(0)+0.5),
                (convert_to_meter(x_corridor+CORR_WIDTH)-0.5, convert_to_meter(CORR_WIDTH)-0.5)
            ]
        }
    )

    room_dict.update({
        'CROWDIT_DESTINATION_'+str(1): [
                (convert_to_meter(LENGTH-CORR_WIDTH)+0.5, convert_to_meter(y_corridor-CORR_WIDTH)+0.5),
                (convert_to_meter(LENGTH)-0.5, convert_to_meter(y_corridor+CORR_WIDTH)-0.5)
            ]
        }
    )

    corridor_walls_left = [Wall.Create(doc, wall_l, default_interior_wall_type.Id, allLevels[0].Id, allLevels[1].Elevation - allLevels[0].Elevation, 0, False, True) 
        for wall_l in corridor_lines_left]
    corridor_walls_right = [Wall.Create(doc, wall_r, default_interior_wall_type.Id, allLevels[0].Id, allLevels[1].Elevation - allLevels[0].Elevation, 0, False, True) 
        for wall_r in corridor_lines_right]

    partition_openings = []

    if INCLUDE_BOTTLENECK:
        bottleneck_lines = [
            Autodesk.Revit.DB.Line.CreateBound(p2_l, p2_r),
            Autodesk.Revit.DB.Line.CreateBound(p4_l, p4_r)
        ]
        bottleneck_walls = [Wall.Create(doc, b_wall, default_interior_wall_type.Id, allLevels[0].Id, allLevels[1].Elevation - allLevels[0].Elevation, 0, False, True) 
            for b_wall in bottleneck_lines]

        # some doors
        x_door_1 = (p2_l.X + p2_r.X) / 2.
        y_door_1 = (p2_l.Y + p2_r.Y) / 2.
        x_door_2 = (p4_l.X + p4_r.X) / 2.
        y_door_2 = (p4_l.Y + p4_r.Y) / 2.
        
        start_point_1 = XYZ(x_door_1-DOOR_WIDTH_H, y_door_1-DOOR_THICKNESS_H, z_level)
        end_point_1 = XYZ(x_door_1+DOOR_WIDTH_H, y_door_1+DOOR_THICKNESS_H, z_level+DOOR_HEIGHT)
        opening_1 = doc.Create.NewOpening(bottleneck_walls[0], start_point_1, end_point_1)

        start_point_2 = XYZ(x_door_2-DOOR_THICKNESS_H, y_door_2-DOOR_WIDTH_H, z_level)
        end_point_2 = XYZ(x_door_2+DOOR_THICKNESS_H, y_door_2+DOOR_WIDTH_H, z_level+DOOR_HEIGHT)
        opening_2 = doc.Create.NewOpening(bottleneck_walls[1], start_point_2, end_point_2)

    outter_office_lines = [
        Autodesk.Revit.DB.Line.CreateBound(
            XYZ(x_corridor+ROOM_WIDTH+CORR_WIDTH/2, 0, ceiling), 
            XYZ(x_corridor+ROOM_WIDTH+CORR_WIDTH/2, y_corridor - ROOM_WIDTH - CORR_WIDTH/2., ceiling)),
        Autodesk.Revit.DB.Line.CreateBound(
            XYZ(x_corridor+ROOM_WIDTH+CORR_WIDTH/2, y_corridor - ROOM_WIDTH - CORR_WIDTH/2., ceiling),
            XYZ(LENGTH, y_corridor - ROOM_WIDTH - CORR_WIDTH/2., ceiling))
    ]
    outter_office_walls = [Wall.Create(doc, o_wall, default_interior_wall_type.Id, allLevels[0].Id, allLevels[1].Elevation - allLevels[0].Elevation, 0, False, True) 
            for o_wall in outter_office_lines]

    edge_room_x = ROOM_WIDTH # + CORR_WIDTH
    # edge room door
    """ start_point_edge = XYZ((edge_room_x+ROOM_WIDTH)/2.-DOOR_WIDTH_H, y_corridor+CORR_WIDTH/2.-DOOR_THICKNESS_H, z_level)
    end_point_edge = XYZ((edge_room_x+ROOM_WIDTH)/2.+DOOR_WIDTH_H, y_corridor+CORR_WIDTH/2.+DOOR_THICKNESS_H, z_level+DOOR_HEIGHT)
    partition_openings.append(doc.Create.NewOpening(corridor_walls_left[3], start_point_edge, end_point_edge))

    # assign room
    room_dict.update({
        'CROWDIT_ORIGIN_'+str(0): [
                (convert_to_meter(0)+0.5, convert_to_meter(y_corridor+CORR_WIDTH/2.)+0.5),
                (convert_to_meter(edge_room_x)-0.5, convert_to_meter(WIDTH)-0.5)
            ]
        }
    ) """

    # side rooms along y
    y_start_rooms = 2*CORR_WIDTH
    y_end_rooms_long = y_corridor + CORR_WIDTH/2.
    y_end_rooms_short = y_corridor - CORR_WIDTH/2.

    NUM_ROOMS_LONG_Y = int((y_end_rooms_long-y_start_rooms) / MIN_ROOM_LENGTH)
    NUM_ROOMS_SHORT_Y = int((y_end_rooms_short-y_start_rooms) / MIN_ROOM_LENGTH)
    fractions_partitions = [1./NUM_ROOMS_LONG_Y*i for i in range(NUM_ROOMS_LONG_Y+1)] if NUM_ROOMS_LONG_Y > 0 else []
    y_pos_partitions_long = [y_start_rooms + fr * (y_end_rooms_long - y_start_rooms) for fr in fractions_partitions] if len(fractions_partitions) > 0 else [y_start_rooms, y_end_rooms_long]
    fractions_partitions = [1./NUM_ROOMS_SHORT_Y*i for i in range(NUM_ROOMS_SHORT_Y+1)] if NUM_ROOMS_SHORT_Y > 0 else []
    y_pos_partitions_short = [y_start_rooms + fr * (y_end_rooms_short - y_start_rooms) for fr in fractions_partitions] if len(fractions_partitions) > 0 else [y_start_rooms, y_end_rooms_short]

    partition_lines = []

    for idy, y_pos_part in enumerate(y_pos_partitions_long):

        partition_lines.append(
            Autodesk.Revit.DB.Line.CreateBound(XYZ(0, y_pos_part, ceiling), XYZ(x_corridor-CORR_WIDTH/2., y_pos_part, ceiling))
        )
        if idy < len(y_pos_partitions_long)-1:
            # assign room
            room_dict.update({
                'CROWDIT_ORIGIN_'+str(idy): [
                        (convert_to_meter(0)+0.5, convert_to_meter(y_pos_part)+0.5),
                        (convert_to_meter(x_corridor-CORR_WIDTH/2.)-0.5, convert_to_meter(y_pos_partitions_long[idy+1])-0.5)
                    ]
                }
            )
            # a door
            start_point_part = XYZ(x_corridor-CORR_WIDTH/2.-DOOR_THICKNESS_H, (y_pos_partitions_long[idy+1]+y_pos_part)/2.-DOOR_WIDTH_H, z_level)
            end_point_part = XYZ(x_corridor-CORR_WIDTH/2.+DOOR_THICKNESS_H, (y_pos_partitions_long[idy+1]+y_pos_part)/2.+DOOR_WIDTH_H, z_level+DOOR_HEIGHT)
            partition_openings.append(doc.Create.NewOpening(corridor_walls_left[2], start_point_part, end_point_part))

            # obstacles
            if idy % 2 == 0:
                obstacle_length = 2.
                x_obst_min, x_obst_max = convert_to_meter(x_corridor-CORR_WIDTH/2.)+0.1, convert_to_meter(x_corridor-CORR_WIDTH/2.)+0.1+OBSTACLE_WIDTH
                y_obst_min, y_obst_max = convert_to_meter(y_pos_part)-obstacle_length/2., convert_to_meter(y_pos_part)+obstacle_length/2.

                room_dict.update({
                    'CROWDIT_OBSTACLE_'+str(obstacle_counter)+'_2_1_': [
                            (x_obst_min, y_obst_min),
                            (x_obst_max, y_obst_max)
                        ]
                    }
                )
                obstacle_counter += 1

    for idy, y_pos_part in enumerate(y_pos_partitions_short[:-1]):

        partition_lines.append(
            Autodesk.Revit.DB.Line.CreateBound(XYZ(x_corridor+CORR_WIDTH/2., y_pos_part, ceiling), XYZ(x_corridor+CORR_WIDTH/2.+ROOM_WIDTH, y_pos_part, ceiling))
        )
        if idy < len(y_pos_partitions_short)-1:
            # assign room
            room_dict.update({
                'CROWDIT_ORIGIN_'+str(idy+len(y_pos_partitions_long)-1): [
                        (convert_to_meter(x_corridor+CORR_WIDTH/2.)+0.5, convert_to_meter(y_pos_part)+0.5),
                        (convert_to_meter(x_corridor+CORR_WIDTH/2.+ROOM_WIDTH)-0.5, convert_to_meter(y_pos_partitions_short[idy+1])-0.5)
                    ]
                }
            )
            # a door
            start_point_part = XYZ(x_corridor+CORR_WIDTH/2.-DOOR_THICKNESS_H, (y_pos_partitions_short[idy+1]+y_pos_part)/2.-DOOR_WIDTH_H, z_level)
            end_point_part = XYZ(x_corridor+CORR_WIDTH/2.+DOOR_THICKNESS_H, (y_pos_partitions_short[idy+1]+y_pos_part)/2.+DOOR_WIDTH_H, z_level+DOOR_HEIGHT)
            partition_openings.append(doc.Create.NewOpening(corridor_walls_right[2], start_point_part, end_point_part))

            # obstacles
            if idy % 2 != 0:
                obstacle_length = 2.
                x_obst_min, x_obst_max = convert_to_meter(x_corridor+CORR_WIDTH/2.)-0.1-OBSTACLE_WIDTH, convert_to_meter(x_corridor+CORR_WIDTH/2.)-0.1
                y_obst_min, y_obst_max = convert_to_meter(y_pos_part)-obstacle_length/2., convert_to_meter(y_pos_part)+obstacle_length/2.

                room_dict.update({
                    'CROWDIT_OBSTACLE_'+str(obstacle_counter)+'_2_1_': [
                            (x_obst_min, y_obst_min),
                            (x_obst_max, y_obst_max)
                        ]
                    }
                )
                obstacle_counter += 1

    # side rooms along x
    x_end_rooms = LENGTH - 2*CORR_WIDTH
    x_start_rooms_long = edge_room_x
    x_start_rooms_short = x_corridor+CORR_WIDTH/2.+ROOM_WIDTH

    NUM_ROOMS_LONG_X = int((x_end_rooms-x_start_rooms_long) / MIN_ROOM_LENGTH)
    NUM_ROOMS_SHORT_X = int((x_end_rooms-x_start_rooms_short) / MIN_ROOM_LENGTH)

    fractions_partitions = [1./NUM_ROOMS_LONG_X*i for i in range(NUM_ROOMS_LONG_X+1)] if NUM_ROOMS_LONG_X > 0 else []
    x_pos_partitions_long = [x_start_rooms_long + fr * (x_end_rooms - x_start_rooms_long) for fr in fractions_partitions] if len(fractions_partitions) > 0 else [x_start_rooms_long, x_end_rooms]
    fractions_partitions = [1./NUM_ROOMS_SHORT_X*i for i in range(NUM_ROOMS_SHORT_X+1)] if NUM_ROOMS_SHORT_X > 0 else []
    x_pos_partitions_short = [x_start_rooms_short + fr * (x_end_rooms - x_start_rooms_short) for fr in fractions_partitions] if len(fractions_partitions) > 0 else [x_start_rooms_short, x_end_rooms]

    for idx, x_pos_part in enumerate(x_pos_partitions_long):

        if idx > 0:
            # Do not create a wall at x = edge_room_x
            partition_lines.append(
                Autodesk.Revit.DB.Line.CreateBound(XYZ(x_pos_part, y_corridor+CORR_WIDTH/2., ceiling), XYZ(x_pos_part, WIDTH, ceiling))
            )
        if idx < len(x_pos_partitions_long)-1:
            # assign room
            room_dict.update({
                'CROWDIT_ORIGIN_'+str(idx+len(y_pos_partitions_short)-1+len(y_pos_partitions_long)-1): [
                        (convert_to_meter(x_pos_part)+0.5, convert_to_meter(y_corridor+CORR_WIDTH/2.)+0.5),
                        (convert_to_meter(x_pos_partitions_long[idx+1])-0.5, convert_to_meter(WIDTH)-0.5)
                    ]
                }
            )
            # a door
            start_point_part = XYZ((x_pos_partitions_long[idx+1]+x_pos_part)/2.-DOOR_WIDTH_H, y_corridor+CORR_WIDTH/2.-DOOR_THICKNESS_H, z_level)
            end_point_part = XYZ((x_pos_partitions_long[idx+1]+x_pos_part)/2.+DOOR_WIDTH_H, y_corridor+CORR_WIDTH/2.+DOOR_THICKNESS_H, z_level+DOOR_HEIGHT)
            partition_openings.append(doc.Create.NewOpening(corridor_walls_left[3], start_point_part, end_point_part))

    
    for idx, x_pos_part in enumerate(x_pos_partitions_short):

        partition_lines.append(
            Autodesk.Revit.DB.Line.CreateBound(XYZ(x_pos_part, y_corridor-CORR_WIDTH/2.-ROOM_WIDTH, ceiling), XYZ(x_pos_part, y_corridor-CORR_WIDTH/2., ceiling))
        )
        if idx < len(x_pos_partitions_short)-1:
            # assign room
            room_dict.update({
                'CROWDIT_ORIGIN_'+str(idx+len(x_pos_partitions_long)-1+len(y_pos_partitions_short)-1+len(y_pos_partitions_long)-1): [
                        (convert_to_meter(x_pos_part)+0.5, convert_to_meter(y_corridor-CORR_WIDTH/2.-ROOM_WIDTH)+0.5),
                        (convert_to_meter(x_pos_partitions_short[idx+1])-0.5, convert_to_meter(y_corridor-CORR_WIDTH/2.)-0.5)
                    ]
                }
            )
            # a door
            start_point_part = XYZ((x_pos_partitions_short[idx+1]+x_pos_part)/2.-DOOR_WIDTH_H, y_corridor-CORR_WIDTH/2.-DOOR_THICKNESS_H, z_level)
            end_point_part = XYZ((x_pos_partitions_short[idx+1]+x_pos_part)/2.+DOOR_WIDTH_H, y_corridor-CORR_WIDTH/2.+DOOR_THICKNESS_H, z_level+DOOR_HEIGHT)
            partition_openings.append(doc.Create.NewOpening(corridor_walls_right[3], start_point_part, end_point_part))

    # obstacles
    # iterate through partition walls in reverse order to generate obstacles
    for idx, x_pos_part in enumerate(x_pos_partitions_long[::-1]):
        if idx % 2 == 0 and idx < len(x_pos_partitions_long)-1:
            obstacle_length = 2.
            x_obst_min, x_obst_max = convert_to_meter(x_pos_part)-obstacle_length/2., convert_to_meter(x_pos_part)+obstacle_length/2.
            y_obst_min, y_obst_max = convert_to_meter(y_corridor+CORR_WIDTH/2.)-0.1-OBSTACLE_WIDTH, convert_to_meter(y_corridor+CORR_WIDTH/2.)-0.1

            room_dict.update({
                'CROWDIT_OBSTACLE_'+str(obstacle_counter)+'_2_1_': [
                        (x_obst_min, y_obst_min),
                        (x_obst_max, y_obst_max)
                    ]
                }
            )
            obstacle_counter += 1

    for idx, x_pos_part in enumerate(x_pos_partitions_short[::-1]):
        if idx % 2 != 0:
            obstacle_length = 2.
            x_obst_min, x_obst_max = convert_to_meter(x_pos_part)-obstacle_length/2., convert_to_meter(x_pos_part)+obstacle_length/2.
            y_obst_min, y_obst_max = convert_to_meter(y_corridor-CORR_WIDTH/2.)+0.1, convert_to_meter(y_corridor-CORR_WIDTH/2.)+0.1+OBSTACLE_WIDTH

            room_dict.update({
                'CROWDIT_OBSTACLE_'+str(obstacle_counter)+'_2_1_': [
                        (x_obst_min, y_obst_min),
                        (x_obst_max, y_obst_max)
                    ]
                }
            )
            obstacle_counter += 1


    # check if as many origin areas as room doors 
    assert len(partition_openings) == len([key for key in room_dict if key.startswith('CROWDIT_ORIGIN')])

    partition_walls = [Wall.Create(doc, p_wall, default_interior_wall_type.Id, allLevels[0].Id, allLevels[1].Elevation - allLevels[0].Elevation, 0, False, True) 
            for p_wall in partition_lines]
    

#--------------------------------------------------------------
#------------------ OK NOW END THE CODE -----------------------
#--------------------------------------------------------------

TransactionManager.Instance.TransactionTaskDone()

###############################################################
# Prepare the output 
###############################################################
OUT = room_dict
# ----------------------------------------
dictExporter = Python(IN[0]=multiLevelGeometryCreator, IN[1]=crossGeometryCreator, IN[2]=E2EGeometryCreator, IN[3]=edgeGeometryCreator, IN[4]=modelSelector)  # CPython3
# ---------- dictExporter.python (12 lines) ----------
# Load the Python Standard and DesignScript Libraries
import sys
import clr
clr.AddReference('ProtoGeometry')
from Autodesk.DesignScript.Geometry import *

model_selector_list = UnwrapElement(IN[4])

geometry_index = model_selector_list.index(True)


OUT = IN[geometry_index]
# ----------------------------------------

# group: View Settings In Revit
hide_elevation_arrows = Python(IN[0]=createFloorPlanWithOverlaidZones, IN[1]=id)  # CPython3
# ---------- hide_elevation_arrows.python (31 lines) ----------
import clr
clr.AddReference("RevitAPI")
from Autodesk.Revit.DB import *

clr.AddReference("RevitServices")
from RevitServices.Persistence import DocumentManager
from RevitServices.Transactions import TransactionManager

from System.Collections.Generic import List

doc = DocumentManager.Instance.CurrentDBDocument
TransactionManager.Instance.EnsureInTransaction(doc)

if UnwrapElement(IN[0]) : 
    viewId = IN[1]
    elementId = ElementId(viewId)
    view = doc.GetElement(elementId)

    elevationArrows = FilteredElementCollector(doc).OfCategory(BuiltInCategory.OST_Elev).ToElementIds()
    viewers = FilteredElementCollector(doc).OfCategory(BuiltInCategory.OST_Viewers).ToElementIds()
    
    if elevationArrows and viewers :
        view.HideElements(List[ElementId](elevationArrows))
        view.HideElements(List[ElementId](viewers))
        
        TransactionManager.Instance.TransactionTaskDone()
        
        OUT = 1
        
    else :
        OUT = 0
# ----------------------------------------
color_walls_black = Python(IN[0]=hide_elevation_arrows, IN[1]=id)  # CPython3
# ---------- color_walls_black.python (48 lines) ----------
#IN[0]: Create Floor plan or not (boolean)

import clr
clr.AddReference('ProtoGeometry')
from Autodesk.DesignScript.Geometry import *

clr.AddReference("RevitAPI")
from Autodesk.Revit.DB import *

clr.AddReference("RevitServices")
from RevitServices.Persistence import DocumentManager
from RevitServices.Transactions import TransactionManager

doc = DocumentManager.Instance.CurrentDBDocument

def OverrideColorPattern(element, color, pattern, view):
    graphicSettings = OverrideGraphicSettings()
    graphicSettings.SetSurfaceForegroundPatternColor(color)
    graphicSettings.SetCutForegroundPatternColor(color)
    graphicSettings.SetSurfaceForegroundPatternId(UnwrapElement(pattern).Id)
    graphicSettings.SetCutForegroundPatternId(UnwrapElement(pattern).Id)
    UnwrapElement(view).SetElementOverrides(element.Id, graphicSettings)

if UnwrapElement(IN[0]) : 
    viewId = IN[1]
    elementId = ElementId(viewId)
    view = doc.GetElement(elementId)

    black = Color(0, 0, 0)
    
    walls = FilteredElementCollector(doc).OfClass(Wall)
    TransactionManager.Instance.EnsureInTransaction(doc)
    
    fillPatterns = FilteredElementCollector(doc).OfClass(FillPatternElement)
    solidPattern = None
    for pattern in fillPatterns:
        if UnwrapElement(pattern).GetFillPattern().IsSolidFill:
            solidPattern = pattern
            break
    
    if solidPattern : 
        for wall in walls:
            OverrideColorPattern(wall, black, solidPattern, view)
    
        TransactionManager.Instance.TransactionTaskDone()
        OUT = 1
    else : 
        OUT = 0
# ----------------------------------------
get_rid_of_cropbox = Python(IN[0]=color_walls_black, IN[1]=id)  # CPython3
# ---------- get_rid_of_cropbox.python (24 lines) ----------
#IN[1]: view element id

import clr
clr.AddReference("RevitAPI")
from Autodesk.Revit.DB import *

clr.AddReference("RevitServices")
from RevitServices.Persistence import DocumentManager
from RevitServices.Transactions import TransactionManager

if UnwrapElement(IN[0]) : 
    doc = DocumentManager.Instance.CurrentDBDocument
    TransactionManager.Instance.EnsureInTransaction(doc)
    
    viewId = IN[1]
    elementId = ElementId(viewId)
    view = doc.GetElement(elementId)
    
    view.CropBoxActive = False
    view.CropBoxVisible = False
    
    TransactionManager.Instance.TransactionTaskDone()
    
    OUT = 1
# ----------------------------------------
show_floors_in_plan = Python(IN[0]=get_rid_of_cropbox)  # CPython3
# ---------- show_floors_in_plan.python (26 lines) ----------
import clr
clr.AddReference("RevitAPI")
from Autodesk.Revit.DB import *

clr.AddReference("RevitServices")
from RevitServices.Persistence import DocumentManager
from RevitServices.Transactions import TransactionManager

if UnwrapElement(IN[0]):
    doc = DocumentManager.Instance.CurrentDBDocument
    
    
    floorCategoryId = BuiltInCategory.OST_Floors
    
    
    activeView = doc.ActiveView
    
    
    floorCategory = Category.GetCategory(doc, floorCategoryId)
    
    
    TransactionManager.Instance.EnsureInTransaction(doc)
    activeView.SetCategoryHidden(floorCategory.Id, False)
    TransactionManager.Instance.TransactionTaskDone()
    
    OUT = 1
# ----------------------------------------

# group: Create Floor Plan From Geometry
getScaledOriginsAndDestinations = Python(IN[0]=dictExporter, IN[1]=show_floors_in_plan)  # CPython3
# ---------- getScaledOriginsAndDestinations.python (23 lines) ----------
#IN[0]: room dict.

import clr
from System.Drawing import *
from Autodesk.DesignScript.Geometry import *
from RevitServices.Persistence import DocumentManager 
from Autodesk.Revit.DB import *

def extract_lists_with_string(room_dict, type):
    extracted_lists = []
    for key in room_dict:
        if type in key:
            extracted_lists.append(room_dict[key])
    return extracted_lists
    
if UnwrapElement(IN[1]) :  
    dict = IN[0]
    
    origins = extract_lists_with_string(dict , "ORIGIN")
    destinations = extract_lists_with_string(dict , "DESTINATION")
    obstacles = extract_lists_with_string(dict , "OBSTACLE")

    OUT = origins , destinations , obstacles
# ----------------------------------------
overlayPlanWithColors = Python(IN[0]=getScaledOriginsAndDestinations, IN[1]=id)  # CPython3
# ---------- overlayPlanWithColors.python (114 lines) ----------
import clr
clr.AddReference("RevitAPI")
from Autodesk.Revit.DB import *

clr.AddReference("RevitServices")
from RevitServices.Persistence import DocumentManager
from RevitServices.Transactions import TransactionManager

doc = DocumentManager.Instance.CurrentDBDocument

def slab_geometry_by_level(x, y, level, delta_z , start_x , start_y):
    zz = level.Elevation + delta_z
    xx = x + start_x
    yy = y + start_y
    line_1 = Line.CreateBound(XYZ(start_x, start_y, zz), XYZ(xx, start_y, zz))
    line_2 = Line.CreateBound(XYZ(xx, start_y, zz), XYZ(xx, yy, zz))
    line_3 = Line.CreateBound(XYZ(xx, yy, zz), XYZ(start_x, yy, zz))
    line_4 = Line.CreateBound(XYZ(start_x, yy, zz), XYZ(start_x, start_y, zz))

    slab_geometry = CurveArray()
    slab_geometry.Append(line_1)
    slab_geometry.Append(line_2)
    slab_geometry.Append(line_3)
    slab_geometry.Append(line_4)
    return slab_geometry

def override_color_pattern(element, color, pattern, view):
    graphicSettings = OverrideGraphicSettings()
    graphicSettings.SetSurfaceForegroundPatternColor(color)
    graphicSettings.SetCutForegroundPatternColor(color)
    graphicSettings.SetSurfaceForegroundPatternId(UnwrapElement(pattern).Id)
    graphicSettings.SetCutForegroundPatternId(UnwrapElement(pattern).Id)
    graphicSettings.SetSurfaceBackgroundPatternId(UnwrapElement(pattern).Id)
    graphicSettings.SetCutBackgroundPatternId(UnwrapElement(pattern).Id)
    graphicSettings.SetProjectionLineColor(color)
    UnwrapElement(view).SetElementOverrides(element.Id, graphicSettings)

def convert_meter_to_unit(pre_value):
    tempo_list = []
    tempo_value = 0
    if isinstance(pre_value, list):
        len_list = len(pre_value)
        for ii in range(len_list):
            tempo_list.append (float(UnitUtils.ConvertToInternalUnits(pre_value[ii], UnitTypeId.Meters)))
        pre_value = tempo_list
    else:
        tempo_value = float(UnitUtils.ConvertToInternalUnits(pre_value, UnitTypeId.Meters))
        pre_value = tempo_value
    return pre_value

def create_colored_floor(length , width , start_x , start_y , level , doc , color) : 
    floor_geometry = slab_geometry_by_level(length, width, level, 1. , start_x , start_y)

    floor = doc.Create.NewFloor(floor_geometry, True)

    override_color_pattern(floor, color, solidPattern, view)


if IN[0] : 
    view_id = IN[1]
    element_id = ElementId(view_id)
    view = doc.GetElement(element_id)

    origins, destinations , obstacles = IN[0]

    level = view.GenLevel

    TransactionManager.Instance.EnsureInTransaction(doc)

    fillPatterns = FilteredElementCollector(doc).OfClass(FillPatternElement)
    solidPattern = None
    for pattern in fillPatterns:
        if UnwrapElement(pattern).GetFillPattern().IsSolidFill:
            solidPattern = pattern
            break

    if solidPattern : 
        red = Color(255 , 0 , 0)
        green = Color(0 , 255 , 0)
        black = Color(0 , 0 , 0)

        for origin in origins : 
            origin_bbox = convert_meter_to_unit([*origin[0], *origin[1]])

            start_x , start_y = origin_bbox[0] , origin_bbox[1]

            size_x = origin_bbox[2] - origin_bbox[0]
            size_y = origin_bbox[3] - origin_bbox[1]

            create_colored_floor(size_x , size_y , start_x , start_y , level , doc , red)
        for destination in destinations : 
            destination_bbox = convert_meter_to_unit([*destination[0], *destination[1]])

            start_x , start_y = destination_bbox[0] , destination_bbox[1]

            size_x = destination_bbox[2] - destination_bbox[0]
            size_y = destination_bbox[3] - destination_bbox[1]

            create_colored_floor(size_x , size_y , start_x , start_y , level , doc , green)
        
        for obstacle in obstacles : 
            obstacle_bbox = convert_meter_to_unit([*obstacle[0], *obstacle[1]])

            start_x , start_y = obstacle_bbox[0] , obstacle_bbox[1]

            size_x = obstacle_bbox[2] - obstacle_bbox[0]
            size_y = obstacle_bbox[3] - obstacle_bbox[1]

            create_colored_floor(size_x , size_y , start_x , start_y , level , doc , black)

        TransactionManager.Instance.TransactionTaskDone()
        OUT = 1
    else : 
        OUT = 0
# ----------------------------------------
exportFloorPlanImage = Python(IN[0]=id, IN[1]=overlayPlanWithColors)  # CPython3
# ---------- exportFloorPlanImage.python (38 lines) ----------
# IN[0] Element id of view

import clr
import System
from System.IO import *
clr.AddReference('ProtoGeometry')
from Autodesk.DesignScript.Geometry import *

clr.AddReference("RevitServices")
import RevitServices
from RevitServices.Persistence import DocumentManager 

clr.AddReference("RevitAPI")
from Autodesk.Revit.DB import *
import tempfile

if UnwrapElement(IN[1]) : 
    doc = DocumentManager.Instance.CurrentDBDocument
    
    viewId = IN[0]
    elementId = ElementId(viewId)
    view = doc.GetElement(elementId)
    
    screenshot_of_view_path = tempfile.mktemp(suffix=".png")
    
    options = ImageExportOptions()
    options.ExportRange = ExportRange.CurrentView
    options.ViewName = view.Name
    options.FilePath = screenshot_of_view_path
    options.ZoomType = ZoomFitType.Zoom
    options.PixelSize = 2048
    
    doc.ExportImage(options)
    
    saved_image_path = f"{screenshot_of_view_path[:-3]}jpg" # Saving as JPG format (unusual behavior)
    
    
    OUT = saved_image_path
# ----------------------------------------
getPaddedImage = Python(IN[0]=exportFloorPlanImage, IN[1]=virtual_environment_path, IN[2]=paddedimagewidth_int, IN[3]=paddedimageheight_int)  # CPython3
# ---------- getPaddedImage.python (57 lines) ----------
# IN[0] Element id of view

import clr
import System
import sys
from System.IO import *
clr.AddReference('ProtoGeometry')
from Autodesk.DesignScript.Geometry import *

clr.AddReference("RevitServices")
import RevitServices
from RevitServices.Persistence import DocumentManager 

clr.AddReference("RevitAPI")
from Autodesk.Revit.DB import *
import tempfile

if UnwrapElement(IN[0]) and IN[1] : 
    package_path = fr"{IN[1]}\lib\site-packages"
    sys.path.append(package_path)
    import cv2
    import numpy as np

    image_path = UnwrapElement(IN[0])
    image = cv2.imread(image_path)
    image_height , image_width , _ = image.shape

    padded_image_width = int(IN[2])
    padded_image_height = int(IN[3])

    site_x = 25
    site_y = 20
    new_image_dimensions = [site_x * 10 , site_y * 10]
    
    padded_image = np.zeros((padded_image_height, padded_image_width , 3), dtype=np.uint8)
    padded_image_centers = [
        int(dim / 2) for dim in [padded_image_width , padded_image_height]
    ]

    # using different interpolation order for upsizing and downsizing
    if site_x * 10 > image_width and site_y * 10 > image_height : 
        scaled_image = cv2.resize(image, tuple(new_image_dimensions), interpolation=cv2.INTER_CUBIC)
    else : 
        scaled_image = cv2.resize(image, tuple(new_image_dimensions), interpolation=cv2.INTER_AREA)

    origin_in_padded_image = [
        int(padded_image_centers[i] - new_image_dimensions[i] / 2) for i in range(2)
    ]

    padded_image[
        origin_in_padded_image[1] : origin_in_padded_image[1] + new_image_dimensions[1] , origin_in_padded_image[0] : origin_in_padded_image[0] + new_image_dimensions[0]
    ] = scaled_image

    padded_image_path = tempfile.mktemp(suffix=".png")
    cv2.imwrite(padded_image_path , padded_image)

    OUT = padded_image_path
# ----------------------------------------
getImageAsBitmap = Python(IN[0]=getPaddedImage)  # CPython3
# ---------- getImageAsBitmap.python (24 lines) ----------
# IN[0] Element id of view

import clr
import System
from System.IO import *
clr.AddReference('ProtoGeometry')
from Autodesk.DesignScript.Geometry import *

clr.AddReference("RevitServices")
import RevitServices
from RevitServices.Persistence import DocumentManager 

clr.AddReference("RevitAPI")
from Autodesk.Revit.DB import *

clr.AddReference('System.Drawing')
import System.Drawing
from System.Drawing import *

if IN[0] : 
    result = Image.FromFile(IN[0])
    
    OUT = result
    
# ----------------------------------------
watch_image = WatchImageCore(image=getImageAsBitmap)

# group: PathChecker
pathChecker = Python(IN[0]=createFloorPlanWithOverlaidZones, IN[1]=virtual_environment_path, IN[2]=nn_checkpoint_path, IN[3]=gif_export_path)  # CPython3
# ---------- pathChecker.python (20 lines) ----------
import sys
import os
import clr
clr.AddReference('ProtoGeometry')
from Autodesk.DesignScript.Geometry import *

if IN[0] and IN[1] and IN[2] and IN[3] : 
    # sys.path.append(r'D:\Work\TUM_Research\HiWiPatrick\PedSimAutomation\DynamoDependencies\DynamoVEnv\lib\site-packages')
    # sys.path.
    package_path = fr"{IN[1]}\lib\site-packages"
    checkpoint_path = fr"{IN[2]}\model_epoch=45-step=230000.pth"
    gif_export_path = IN[3]

    if os.path.isdir(package_path) and os.path.isdir(gif_export_path) and os.path.exists(checkpoint_path):
        OUT = 1
    else : 
        raise ImportError("VEnv not found. Make sure the venv path is correct and the venv contains opencv-python and numpy. The venv should also use the same python version as dynamo.")
        
else : 
    raise ImportError("Choose all three paths for this part of the code to work properly.")
# ----------------------------------------

# group: Inference
nn_forwardpass = Python(IN[0]=virtual_environment_path, IN[1]=nn_checkpoint_path, IN[2]=getPaddedImage)  # CPython3
# ---------- nn_forwardpass.python (720 lines) ----------
import sys
package_path = fr"{IN[0]}\lib\site-packages"
sys.path.append(package_path)

import torch
import torch.nn as nn
import torch.nn.functional as F
from torch import einsum, nn
from torchvision import transforms
from transformers.models.beit.modeling_beit import BeitEncoder, BeitLayer, BeitModelOutputWithPooling, BeitEmbeddings, BeitRelativePositionBias, BeitConfig
from transformers.activations import ACT2FN
from transformers.modeling_outputs import BaseModelOutput
import numpy as np
from einops import rearrange, repeat
import PIL
from PIL import Image as PilImage
import matplotlib.pyplot as plt
from collections import OrderedDict
import math
import tempfile

if UnwrapElement(IN[0]) and UnwrapElement(IN[1]) and UnwrapElement(IN[2]) : 
# if 1 : 
    class MyModel(nn.Module):
        def __init__(self, mode, output_channels, num_heads, additional_info, config) -> None:
            super().__init__()

            assert mode in ['denseClass_wEvac', 'density_class']
            # assert additional_info == True
            self.mode = mode
            self.additional_info = additional_info

            # Sequence? TF or visual TF
            # TODO last layer --> BN,  so far 68472 samples, with corr_edge it is 130356
            # --[CHECK]-- positional embedding yes/no? if yes, self.position_embeddings + emb or like CoCa?
            # --[CHECK]-- attention pooling for image tokens (CoCa)
            # loss functions (wCE vs Tversky)
            # img reading (padded vs raw)
            # network: self.attention_key/val/qu  VS.  q, k, v, ff = self.fused_attn_ff_proj(x).split(self.fused_dims, dim=-1) (CoCa)
            # --[CHECK]-- marriage: how (cross attention vs concatenation) and where (before/after)

            # contrastive loss?
            self.decoder_mode = config['decoder_mode']
            self.settings = config['settings']
            self.output_channels = output_channels
            self.num_frames = num_heads
            self.add_info_length = 5 
            self.final_conv_batch = self.settings['final_conv_batch'] if 'final_conv_batch' in self.settings else False

            self.output_hidden_states = False
            self.marriage_mode = self.settings['marriage_mode'] # 0=before, 1=during, 2=after
            if self.marriage_mode == 1: raise NotImplementedError('During attention requires as many CrossAttention layers as TF layers')
            
            # EMBEDDING IMAGE
            self.patch_size = 16
            self.num_channels = 3
            self.hidden_size = self.settings['hidden_size'] # 768 as default

            self.image_size = (640, 640) # None
            self.window = (self.image_size[0] // self.patch_size, self.image_size[1] // self.patch_size) if self.image_size is not None else None

            # BEIT LAYERS
            # beit_model_config = BeitForSemanticSegmentation.from_pretrained('microsoft/beit-base-finetuned-ade-640-640').config
            from transformers.models.beit.modeling_beit import BeitConfig
            beit_model_config = BeitConfig.from_pretrained('microsoft/beit-base-finetuned-ade-640-640')
            beit_model_config.num_hidden_layers = config['num_hidden_img_layers']
            """config_pretrained = beit_model.config
            config_pretrained.hidden_size = self.hidden_size
            config_pretrained.use_mask_token = False
            config_pretrained.use_absolute_position_embeddings = False
            config_pretrained.hidden_dropout_prob = 0.0
            config_pretrained.image_size = 640
            config_pretrained.patch_size = 16
            config_pretrained.num_channels = 3
            config_pretrained.layer_norm_eps = 1e-12
            config_pretrained.use_mean_pooling = True
            config_pretrained.use_shared_relative_position_bias = True """
            # self.beit = BeitModel(beit_model_config)

            self.beit_embeddings = BeitEmbeddings(beit_model_config)
            self.encoder = BeitEncoder(beit_model_config)
            
            dpr = [x.item() for x in torch.linspace(0, beit_model_config.drop_path_rate, beit_model_config.num_hidden_layers)]
            self.encoder.layer = nn.ModuleList([
                nn.ModuleList([
                    BeitLayer(beit_model_config,
                        window_size=self.beit_embeddings.patch_embeddings.patch_shape if beit_model_config.use_relative_position_bias else None,
                        drop_path_rate=dpr[i],
                    ),
                    CrossAttention(dim=self.hidden_size, context_dim=self.hidden_size, dim_head=64, heads=12, norm_context=True, ff_mult=True)
                ]) for i in range(beit_model_config.num_hidden_layers)
            ])

            self.encoder.forward = self.forward_encoder  

            # EMBEDDING SIMULATION PARAMETERS
            if self.additional_info:
                # distr
                # assert (self.hidden_size / self.add_info_length).is_integer()
                # self.od_distances_embedding = nn.Linear(16, self.hidden_size) # //self.add_info_length)
                self.origin_embedding = nn.Embedding(8, self.hidden_size) # nn.Linear(1, self.hidden_size) 
                self.destination_embedding = nn.Embedding(2, self.hidden_size) # nn.Linear(1, self.hidden_size)
                self.num_agents_embedding = nn.Embedding(3, self.hidden_size) # nn.Linear(1, self.hidden_size)
                self.fp_size_embedding = nn.Linear(2, self.hidden_size)
                self.vel_embedding = nn.Embedding(3, self.hidden_size) # nn.Linear(1, self.hidden_size)
                self.input_emb_scale = 8

                self.input_embedding = nn.Linear(self.add_info_length * self.hidden_size, self.add_info_length * self.hidden_size)
                # self.input_embedding = nn.Linear(self.add_info_length * self.hidden_size, self.input_emb_scale * self.hidden_size)
            if mode=='denseClass_wEvac':
                self.evac_preprocess = nn.Linear(self.add_info_length * self.hidden_size,self.add_info_length * self.hidden_size) 
                self.evac_predictor = nn.Linear(self.add_info_length * self.hidden_size, 1)

                # several layers?
                self.num_hidden_ca_layers = self.settings['num_hidden_ca_layers']
                # self.marriage_att = CrossAttention(dim=self.hidden_size, context_dim=self.hidden_size, dim_head=64, heads=12, norm_context=True, ff_mult=True)
                self.marriage_att = nn.ModuleList([
                    CrossAttention(dim=self.hidden_size, context_dim=self.hidden_size, dim_head=64, heads=12, norm_context=True, ff_mult=True) for i in range(self.num_hidden_ca_layers)
                ])
                # also cross attention here?


            if self.settings['use_pe']:
                # self.positional_embedding = nn.Parameter(torch.zeros(1, num_patches + 1, config.hidden_size))
                max_len = 10000
                self.positional_encoding = torch.zeros(max_len, self.hidden_size)
                position = torch.arange(0, max_len).unsqueeze(1).float()
                div_term = torch.exp(torch.arange(0, self.hidden_size, 2).float() * -(math.log(10000.0) / self.hidden_size))
                self.positional_encoding[:, 0::2] = torch.sin(position * div_term)
                self.positional_encoding[:, 1::2] = torch.cos(position * div_term)
                self.positional_encoding = self.positional_encoding.unsqueeze(0)

            if self.settings['attn_pooling']:
                # attention pooling for image tokens
                self.img_queries = nn.Parameter(torch.randn(self.hidden_size, self.hidden_size)) # 256, self.hidden_size))
                self.img_attn_pool = CrossAttention(dim=self.hidden_size, context_dim=self.hidden_size, dim_head=64, heads=12, norm_context=True)
                self.img_attn_pool_norm = nn.LayerNorm(self.hidden_size)
                

            # HOW TO DECODE FROM hidden_states
            if self.decoder_mode == 'fpn':
                from transformers.models.beit.modeling_beit import BeitUperHead, BeitConfig
                self.output_hidden_states = True
                # FPN
                self.out_indices = [3, 5, 7, 11]

                self.fpn1 = nn.Sequential(
                    nn.ConvTranspose2d(self.hidden_size, self.hidden_size, kernel_size=2, stride=2),
                    nn.BatchNorm2d(self.hidden_size),
                    nn.GELU(),
                    nn.ConvTranspose2d(self.hidden_size, self.hidden_size, kernel_size=2, stride=2),
                )
                self.fpn2 = nn.Sequential(
                    nn.ConvTranspose2d(self.hidden_size, self.hidden_size, kernel_size=2, stride=2),
                )
                self.fpn3 = nn.Identity()
                self.fpn4 = nn.MaxPool2d(kernel_size=2, stride=2)

                # Semantic segmentation head(s)           
                self.decode_head = BeitUperHead(beit_model_config)
                self.decode_head.classifier = ClassMovieClassifier(self.hidden_size, self.output_channels, self.num_frames, self.final_conv_batch)
                # nn.ModuleList(
                #     [nn.Sequential(
                #         nn.Conv2d(self.hidden_size, self.output_channels, kernel_size=1), 
                #         nn.ReLU()) for i in range(self.num_frames)]
                # )

            elif self.decoder_mode == 'trans_conv':
                self.tc1 = nn.Sequential(
                    nn.ConvTranspose2d(self.hidden_size, self.hidden_size, kernel_size=2, stride=2),
                    nn.BatchNorm2d(self.hidden_size),
                    nn.GELU(),
                    nn.ConvTranspose2d(self.hidden_size, self.hidden_size, kernel_size=2, stride=2),
                )
                self.tc2 = nn.Sequential(
                    nn.ConvTranspose2d(self.hidden_size, self.hidden_size, kernel_size=2, stride=2),
                )
                self.tc3 = nn.MaxPool2d(kernel_size=2, stride=2)

                self.decode_head = ClassMovieClassifier(self.hidden_size, self.output_channels, self.num_frames, self.final_conv_batch) 

            self.apply(self._initialize_weights)

        
        def _initialize_weights(self, m):
            if hasattr(m, 'weight'):
                try:
                    torch.nn.init.xavier_normal_(m.weight)
                    # torch.nn.init.normal_(m.weight, mean=0, std=0.1)
                    # m.weight.data.uniform_(-0.1, 0.1)
                except ValueError:
                    # Prevent ValueError("Fan in and fan out can not be computed for tensor with fewer than 2 dimensions")
                    m.weight.data.uniform_(-0.2, 0.2)
                    # print("Bypassing ValueError...")
            elif hasattr(m, 'bias'):
                m.bias.data.zero_()


        def forward(self, pixel_values: torch.Tensor, add_info = None) -> torch.Tensor:
            batch_size, num_channels, height, width = pixel_values.shape
            assert height % self.patch_size == 0 and width % self.patch_size == 0, 'Image size not patchable!'

            if add_info is not None:
                # distances = add_info[0]
                num_origins_id = add_info[0]-1
                num_destinations_id = add_info[1]-1
                num_agents_id= add_info[2]
                fp_size = add_info[3]
                velocity_id = add_info[4]

                if fp_size.ndim == 1:
                    fp_size = fp_size.unsqueeze(0)

                or_emb = self.origin_embedding(num_origins_id)
                dest_emb = self.destination_embedding(num_destinations_id)
                num_ag_emb = self.num_agents_embedding(num_agents_id)
                fp_size_emb = self.fp_size_embedding(fp_size)
                vel_emb = self.vel_embedding(velocity_id)

                info_emb = torch.cat((or_emb, dest_emb, num_ag_emb, fp_size_emb, vel_emb), dim=-1)
                info_emb = self.input_embedding(info_emb).view(batch_size, self.add_info_length, self.hidden_size)

            # if self.settings['use_pe']:
            #     add_me = self.positional_encoding[:, :hidden_states.size(1), :].repeat(batch_size, 1, 1).to(hidden_states.device)
            #     hidden_states = hidden_states + add_me
            
            embedding_output = self.beit_embeddings(pixel_values, None)

            encoder_outputs = self.encoder(
                embedding_output,
                info_emb,
                bool_masked_pos = None,
                head_mask = None,
                output_attentions = None,
                output_hidden_states = True,
                return_dict = True,
            )
            sequence_output = encoder_outputs[0]

            beit_model_output = BeitModelOutputWithPooling(
                last_hidden_state=sequence_output,
                pooler_output=None,
                hidden_states=encoder_outputs.hidden_states,
                attentions=encoder_outputs.attentions,
            )

            hidden_states = beit_model_output.last_hidden_state
            all_hidden_states = beit_model_output.hidden_states
            
            if self.settings['attn_pooling']:
                img_queries = repeat(self.img_queries, 'n d -> b n d', b=hidden_states.shape[0])
                img_queries = self.img_attn_pool(img_queries, hidden_states)
                img_queries = self.img_attn_pool_norm(img_queries)
        
            # patch_resolution * 4
            if self.decoder_mode == 'fpn':
                # FPNs: input: (640, 640), hidden_states: (2, 1600, 768) --> (2, 5, 160, 160)  //  input: (768, 256), hidden_states: (2, 768, 768) --> (2, 5, 192, 64)
                features = [feature for idx, feature in enumerate(all_hidden_states) if idx + 1 in self.out_indices]
                batch_size = hidden_states.size()[0] # pixel_values.shape[0]
                patch_resolution_h, patch_resolution_w = height // self.patch_size, width // self.patch_size
                # reshape hidden states
                features = [
                    x[:,1:,:].permute(0, 2, 1).reshape(batch_size, -1, patch_resolution_h, patch_resolution_w) for x in features
                ]
                
                ops = [self.fpn1, self.fpn2, self.fpn3, self.fpn4]
                for i in range(len(features)):
                    features[i] = ops[i](features[i])
                
                logits = self.decode_head(features)
                logits = torch.stack(logits, dim=2).squeeze()

            # patch_resolution * 4
            elif self.decoder_mode == 'trans_conv':
                patch_resolution_h, patch_resolution_w = height // self.patch_size, width // self.patch_size
                features = hidden_states.permute(0, 2, 1).reshape(batch_size, -1, patch_resolution_h, patch_resolution_w)

                for tc in [self.tc1, self.tc2, self.tc3]:
                    features = tc(features)
                
                logits = self.decode_head(features)
                logits = torch.stack(logits, dim=2).squeeze()

                
            # MARRIAGE AFTER
            if self.mode=='denseClass_wEvac' and add_info is not None:
                info_emb_2 = torch.cat((or_emb, dest_emb, num_ag_emb, fp_size_emb, vel_emb), dim=-1)
                info_emb_2 = self.evac_preprocess(info_emb_2)

                # info_emb = self.marriage_att(info_emb, img_queries) if self.settings['attn_pooling'] else self.marriage_att(info_emb, hidden_states)
                for marr_layer in self.marriage_att:
                    info_emb = marr_layer(info_emb, hidden_states) # if self.settings['attn_pooling'] else marr_layer(info_emb, hidden_states)

                info_emb = info_emb.flatten(start_dim=1)
                info_emb = info_emb + info_emb_2
                evac_prediction = self.evac_predictor(info_emb)
                evac_prediction = nn.ReLU()(evac_prediction) # + upper theshold ReLU()?
                evac_prediction = torch.multiply(evac_prediction, 100.)

                return logits, evac_prediction
            
            return logits
        

        def forward_encoder(
            self,
            hidden_states,
            vector_embeddings,
            bool_masked_pos = None,
            head_mask = None,
            output_attentions = False,
            output_hidden_states = True,
            return_dict = True,
        ):
            # assuming relative_position_bias = None and gradient_checkpointing = False
            all_hidden_states = () if output_hidden_states else None
            all_self_attentions = () if output_attentions else None

            for i, layer_modules in enumerate(self.encoder.layer):
                if output_hidden_states:
                    all_hidden_states = all_hidden_states + (hidden_states,)

                beit_layer = layer_modules[0]
                ca_layer = layer_modules[1]

                layer_outputs = beit_layer(hidden_states, None, output_attentions, None)
                layer_outputs = (ca_layer(layer_outputs[0], vector_embeddings), )

                hidden_states = layer_outputs[0]

                if output_attentions:
                    all_self_attentions = all_self_attentions + (layer_outputs[1],)

            if output_hidden_states:
                all_hidden_states = all_hidden_states + (hidden_states,)

            if not return_dict:
                return tuple(v for v in [hidden_states, all_hidden_states, all_self_attentions] if v is not None)
            return BaseModelOutput(
                last_hidden_state=hidden_states,
                hidden_states=all_hidden_states,
                attentions=all_self_attentions,
            )


    class Layer(nn.Module):
        def __init__(self, drop_path_rate=0.0, num_attention_heads=12, hidden_size=768, window=None) -> None:
            super().__init__()
            self.intermediate_size = 3072
            self.dropout_rate = drop_path_rate
            self.layer_scale_init_value = 0.1
            self.window = window

            # BeitSelfAttention (BeitAttention)
            self.num_attention_heads = num_attention_heads
            self.hidden_size = hidden_size
            assert self.hidden_size % self.num_attention_heads == 0, f'The hidden size {self.hidden_size,} is not a multiple of num_attention_heads!'
            self.attention_head_size = int(self.hidden_size / self.num_attention_heads)
            self.all_head_size = self.num_attention_heads * self.attention_head_size

            self.attention_query = nn.Linear(self.hidden_size, self.all_head_size)
            self.attention_key = nn.Linear(self.hidden_size, self.all_head_size, bias=False)
            self.attention_value = nn.Linear(self.hidden_size, self.all_head_size)
            if self.window is not None:
                config_pretrained = BeitConfig()
                config_pretrained.num_attention_heads = self.num_attention_heads
                self.attention_rel_pos_bias = BeitRelativePositionBias(config_pretrained, window_size=self.window)

            # BeitSelfOutput (BeitAttention)
            self.attention_output = nn.Linear(self.hidden_size, self.hidden_size)

            # BeitIntermediate
            self.intermediate = nn.Linear(self.hidden_size, self.intermediate_size)
            self.intermediate_act_fn = ACT2FN['gelu']

            # BeitOutput
            self.output = nn.Linear(self.intermediate_size, self.hidden_size)

            self.layernorm_before = nn.LayerNorm(self.hidden_size, eps=1e-12)
            self.drop_path = BeitDropPath(self.dropout_rate) if self.dropout_rate > 0.0 else nn.Identity()
            self.layernorm_after = nn.LayerNorm(self.hidden_size, eps=1e-12)
            init_values = self.layer_scale_init_value
            if init_values > 0:
                self.lambda_1 = nn.Parameter(init_values * torch.ones((self.hidden_size)), requires_grad=True)
                self.lambda_2 = nn.Parameter(init_values * torch.ones((self.hidden_size)), requires_grad=True)

        
        def transpose_for_scores(self, x):
            new_x_shape = x.size()[:-1] + (self.num_attention_heads, self.attention_head_size)
            x = x.view(*new_x_shape)
            return x.permute(0, 2, 1, 3)

            
        def forward(self, hidden_states):

            mixed_query_layer = self.attention_query(self.layernorm_before(hidden_states))

            key_layer = self.transpose_for_scores(self.attention_key(hidden_states))
            value_layer = self.transpose_for_scores(self.attention_value(hidden_states))
            query_layer = self.transpose_for_scores(mixed_query_layer)

            # Take the dot product between "query" and "key" to get the raw attention scores.
            attention_scores = torch.matmul(query_layer, key_layer.transpose(-1, -2))
            attention_scores = attention_scores / math.sqrt(self.attention_head_size)

            # Add relative position bias if present.
            if self.window is not None:
                attention_scores = attention_scores + self.attention_rel_pos_bias()[:,1:,1:].unsqueeze(0) # cls token not included, thats why [:,1:,1:]

            # Normalize the attention scores to probabilities.
            attention_probs = nn.functional.softmax(attention_scores, dim=-1)

            context_layer = torch.matmul(attention_probs, value_layer)

            context_layer = context_layer.permute(0, 2, 1, 3).contiguous()
            new_context_layer_shape = context_layer.size()[:-2] + (self.all_head_size,)
            context_layer = context_layer.view(*new_context_layer_shape)

            attention_output = self.attention_output(context_layer)

            if self.lambda_1 is not None:
                attention_output = self.lambda_1 * attention_output
            
            # first residual connection
            hidden_states = self.drop_path(attention_output) + hidden_states

            layer_output = self.layernorm_after(hidden_states)

            layer_output = self.intermediate(layer_output)
            layer_output = self.output(layer_output)

            if self.lambda_2 is not None:
                layer_output = self.lambda_2 * layer_output

            # second residual connection
            outputs = self.drop_path(layer_output) + hidden_states

            return outputs


    class CrossAttention(nn.Module):
        def __init__(
            self,
            dim,
            context_dim=None,
            dim_head=64,
            heads=8,
            parallel_ff=False,
            ff_mult=4,
            norm_context=False
        ):
            super().__init__()
            self.heads = heads
            self.scale = dim_head ** -0.5
            inner_dim = heads * dim_head

            def default(val, d):
                def exists(val):
                    return val is not None
                return val if exists(val) else d
            
            context_dim = default(context_dim, dim)

            self.norm = nn.LayerNorm(dim)
            self.context_norm = nn.LayerNorm(context_dim) if norm_context else nn.Identity()

            self.to_q = nn.Linear(dim, inner_dim, bias=False)
            self.to_kv = nn.Linear(context_dim, dim_head * 2, bias=False)
            self.to_out = nn.Linear(inner_dim, dim, bias=False)

            # whether to have parallel feedforward

            ff_inner_dim = ff_mult * dim

            self.ff = nn.Sequential(
                nn.Linear(dim, ff_inner_dim * 2, bias=False),
                SwiGLU(),
                nn.Linear(ff_inner_dim, dim, bias=False)
            ) if parallel_ff else None

        def forward(self, x, context):
            """
            einstein notation
            b - batch
            h - heads
            n, i, j - sequence length (base sequence length, source, target)
            d - feature dimension
            """

            # pre-layernorm, for queries and context

            x = self.norm(x)
            context = self.context_norm(context)

            # get queries

            q = self.to_q(x)
            q = rearrange(q, 'b n (h d) -> b h n d', h = self.heads)

            # scale

            q = q * self.scale

            # get key / values

            k, v = self.to_kv(context).chunk(2, dim=-1)

            # query / key similarity

            sim = einsum('b h i d, b j d -> b h i j', q, k)

            # attention

            sim = sim - sim.amax(dim=-1, keepdim=True)
            attn = sim.softmax(dim=-1)

            # aggregate

            out = einsum('b h i j, b j d -> b h i d', attn, v)

            # merge and combine heads

            out = rearrange(out, 'b h n d -> b n (h d)')
            out = self.to_out(out)

            # add parallel feedforward (for multimodal layers)
            if self.ff:
                out = out + self.ff(x)

            return out


    class BeitDropPath(nn.Module):
        """Drop paths (Stochastic Depth) per sample (when applied in main path of residual blocks)."""

        def __init__(self, drop_prob: float = None) -> None:
            super().__init__()
            self.drop_prob = drop_prob

        def forward(self, x: torch.Tensor) -> torch.Tensor:
            """
                Drop paths (Stochastic Depth) per sample (when applied in main path of residual blocks).

                Comment by Ross Wightman: This is the same as the DropConnect impl I created for EfficientNet, etc networks,
                however, the original name is misleading as 'Drop Connect' is a different form of dropout in a separate paper...
                See discussion: https://github.com/tensorflow/tpu/issues/494#issuecomment-532968956 ... I've opted for changing the
                layer and argument names to 'drop path' rather than mix DropConnect as a layer name and use 'survival rate' as the
                argument.
            """

            if self.drop_prob == 0.0 or not self.training:
                return x
            keep_prob = 1 - self.drop_prob
            shape = (x.shape[0],) + (1,) * (x.ndim - 1)  # work with diff dim tensors, not just 2D ConvNets
            random_tensor = keep_prob + torch.rand(shape, dtype=x.dtype, device=x.device)
            random_tensor.floor_()  # binarize
            output = x.div(keep_prob) * random_tensor
            return output



    class SwiGLU(nn.Module):
        def forward(self, x):
            x, gate = x.chunk(2, dim=-1)
            return F.silu(gate) * x


    class ClassMovieClassifier(nn.Module):
        def __init__(self, input_channels, output_channels, num_frames, final_batch=False) -> None:
            super().__init__()

            if not final_batch:
                self.module_list = nn.ModuleList([
                    nn.Sequential(
                        nn.Conv2d(input_channels, output_channels, kernel_size=1),
                        nn.ReLU()
                    ) for i in range(num_frames)
                ])

            else:
                self.module_list = nn.ModuleList([
                    nn.Sequential(
                        nn.Conv2d(input_channels, output_channels, kernel_size=1),
                        nn.BatchNorm2d(output_channels),
                        nn.ReLU()
                    ) for i in range(num_frames)
                ])

            self.apply(self._initialize_weights)
        
        def _initialize_weights(self, m):
            if hasattr(m, 'weight') or hasattr(m, 'bias'):
                try:
                    torch.nn.init.xavier_normal_(m.weight)
                except ValueError:
                    # Prevent ValueError("Fan in and fan out can not be computed for tensor with fewer than 2 dimensions")
                    m.weight.data.uniform_(-0.2, 0.2)
                    # print("Bypassing ValueError...")
                if m.bias is not None:
                    m.bias.data.zero_()

        def forward(self, input):
            return [module(input) for module in self.module_list]

    def get_color(class_label):
        if class_label == 1: return np.array([143, 225,255], dtype=np.uint8)
        elif class_label == 2: return np.array([0, 0, 255], dtype=np.uint8)
        elif class_label == 3: return np.array([255, 0,255], dtype=np.uint8)
        return None


    CUDA_DEVICE = 'cpu' # 0, 1 or 'cpu'
    MODE = 'density_class'# implemented: grayscale, evac, evac_only, class_movie, density_reg, density_class, denseClass_wEvac
    BATCH_SIZE = 2
    ARCH = 'MyModel' # MyModel, DeepLab, BeIT, SegFormer
    ADD_INFO = True

    test_run = True # limit_batches -> 2 
    save_model = False # create folder and save the model

    # example input coming from the outside
    num_origins = torch.LongTensor([4])
    num_destinations = torch.LongTensor([1])
    num_agents_id = torch.LongTensor([2])
    site_dimensions = torch.FloatTensor([0.55, 0.3])
    velocity_id = torch.LongTensor([2])

    add_info = [num_origins, num_destinations, num_agents_id, site_dimensions, velocity_id]

    config = {
        'decoder_mode': 'fpn',
        'settings': {'final_conv_batch': True, 'marriage_mode': 2, 'hidden_size': 768, 'num_hidden_ca_layers': 3, 'use_pe': False, 'attn_pooling': False},
        'num_hidden_img_layers': 6
    }
    model = MyModel('density_class', output_channels=4, num_heads=8, additional_info=True, config=config)

    model.eval()

    # image = np.array(PIL.Image.open('C:\\Users\\ga78jem\\Downloads\\test_image.png')) 
    # image = np.array(PIL.Image.open(r"C:\Users\mohab\Documents\TUM\HiWiPatrick\PedSimAutomation\DynamoDependencies/PlaceholderScripts/ForwardPass/tmpn98l4445.png")) 
    image = np.array(PIL.Image.open(IN[2]))
    image_t = image.transpose(2,0,1).astype(np.float32) / 255.
    image_t = torch.tensor(image_t).unsqueeze(0)
    image_t = transforms.Normalize(mean=[0.5,0.5,0.5], std=[0.5,0.5,0.5])(image_t)

    # prediction_raw = model(image_t, add_info)

    # load checkpoint
    # ckpt = 'C:\\Users\\ga78jem\\Downloads\\model_epoch=45-step=230000.pth'
    # ckpt = r"C:\Users\mohab\Documents\TUM\HiWiPatrick\PedSimAutomation\DynamoDependencies/PlaceholderScripts/ForwardPass/model_epoch=45-step=230000.pth"
    ckpt = fr"{IN[1]}\model_epoch=45-step=230000.pth"
    # ckpt = "./model_epoch=45-step=230000.pth"
    # state_dict = OrderedDict([(key.replace('model.', ''), tensor.cpu()) if key.startswith('model.') else (key, tensor) for key, tensor in torch.load(ckpt).items()])
    state_dict = OrderedDict([(key.replace('model.', ''), tensor.cpu()) if key.startswith('model.') else (key, tensor) for key, tensor in torch.load(ckpt , map_location=torch.device('cpu')).items()])
    module_state_dict = model.state_dict()

    mkeys_missing_in_loaded = [module_key for module_key in list(module_state_dict.keys()) if module_key not in list(state_dict.keys())]
    lkeys_missing_in_module = [loaded_key for loaded_key in list(state_dict.keys()) if loaded_key not in list(module_state_dict.keys())]

    load_dict = OrderedDict()
    for key, tensor in module_state_dict.items():
        if key in state_dict.keys():
            load_dict[key] = state_dict[key]
        else:
            load_dict[key] = tensor

    model.load_state_dict(load_dict)

    # evac time prediction is still missing
    # FORWARD PASS & VISUALIZATION
    if MODE == 'denseClass_wEvac':
        dense_pred, evac_time_pred = model(image_t, add_info)
        MODE = 'density_class'
    else:
        dense_pred = model(image_t, add_info)

    predicted_frames = []

    dense_pred = dense_pred.squeeze().cpu().detach().numpy()
    dense_pred = np.argmax(dense_pred, axis=0)
    dense_pred = dense_pred.transpose(1,2,0)
    num_frames = dense_pred.shape[-1]

    cell_size = 4
    add_vector_template = np.zeros((cell_size**2,2), dtype=np.int32)
    for x in range(cell_size):
        for y in range(cell_size):
            add_vector_template[cell_size*x + y] = np.array([x, y], dtype=np.int32)

    for frame_id in range(num_frames):

        frame_pred_np = dense_pred[:,:,frame_id]
        nnz_coords = np.argwhere(frame_pred_np > 0).squeeze()
        pred_counts = frame_pred_np[nnz_coords[:,0], nnz_coords[:,1]]
        # scale up
        nnz_coords = np.repeat(nnz_coords, cell_size**2, axis=0) * cell_size
        add_vector = np.tile(add_vector_template.transpose(1,0), np.argwhere(frame_pred_np > 0).squeeze().shape[0]).transpose(1,0)
        nnz_coords += add_vector
        pred_counts = np.repeat(pred_counts, cell_size**2, axis=0)
        pred_counts_colored = [get_color(count) for count in pred_counts]
        binned_pred_img = image.copy()
        if len(pred_counts_colored) > 0: binned_pred_img[nnz_coords[:,0], nnz_coords[:,1]] = pred_counts_colored

        plt.imshow(binned_pred_img)
        plt.close('all')

        predicted_frames.append(binned_pred_img)

    # last_frame = PilImage.fromarray(predicted_frames[-1])
    temp_images_paths = []
    for f , frame in enumerate(predicted_frames) : 
        frame_as_image = PilImage.fromarray(frame)
        temp_inference_image_path = tempfile.mktemp(suffix=".png")
        # frame_as_image.save(f"C:/Users/mohab/Documents/TUM/HiWiPatrick/PedSimAutomation/DynamoDependencies/PlaceholderScripts/ForwardPass/{f}.png")
        frame_as_image.save(temp_inference_image_path)
        temp_images_paths.append(temp_inference_image_path)
        # last_frame.save(temp_inference_image_path)

    # OUT = temp_inference_image_path
    OUT = temp_images_paths
# ----------------------------------------
exportResultAsGif = Python(IN[0]=nn_forwardpass, IN[1]=gif_export_path)  # CPython3
# ---------- exportResultAsGif.python (13 lines) ----------
from PIL import Image


if IN[0] : 
    paths = IN[0]
    save_path = IN[1]
    frames = [
            Image.open(path).convert('RGB') for path in paths
    ]

    frames[0].save(f'{save_path}/prediction.gif', format='GIF', append_images=frames[1:], save_all=True, duration=100 * len(frames), loop=0)

    OUT = "DONE"
# ----------------------------------------

edgeCreationByLevel = Python(IN[0]=default_interior_wall_types, IN[1]=parameterPreprocessor, IN[2]=door_width, IN[3]=obstacle_width, IN[4]=room_width)  # CPython3
# ---------- edgeCreationByLevel.python (363 lines) ----------
import os
import clr
import sys
import math
import System

from System import Array
from System.Collections.Generic import *

clr.AddReference("RevitNodes")
import Revit

clr.ImportExtensions(Revit.Elements)
clr.ImportExtensions(Revit.GeometryConversion)

clr.AddReference("RevitServices")
import RevitServices
from RevitServices.Persistence import DocumentManager 
from RevitServices.Transactions import TransactionManager 

clr.AddReference("RevitAPI")
clr.AddReference("RevitAPIUI")

clr.AddReference('ProtoGeometry')
import Autodesk 
from Autodesk.DesignScript.Geometry import *
from Autodesk.Revit.DB import *
#from Autodesk.Revit.UI import *
from Autodesk.Revit.DB import StairsEditScope
from Autodesk.Revit.DB import Parameter
from Autodesk.Revit.DB.Architecture import StairsRun
from Autodesk.Revit.DB.Architecture import *
from Autodesk.Revit.DB import IFailuresPreprocessor

def convert_to_meter(internal_value):
	if isinstance(internal_value, list):
		return [UnitUtils.ConvertFromInternalUnits(value, UnitTypeId.Meters) for value in internal_value]
	return float(UnitUtils.ConvertFromInternalUnits(internal_value, UnitTypeId.Meters))

def convert_meter_to_unit(pre_value):
    tempo_list = []
    tempo_value = 0
    if isinstance(pre_value, list):
        len_list = len(pre_value)
        for ii in range(len_list):
            tempo_list.append (float(UnitUtils.ConvertToInternalUnits(pre_value[ii], UnitTypeId.Meters)))
        pre_value = tempo_list
    else:
        tempo_value = float(UnitUtils.ConvertToInternalUnits(pre_value, UnitTypeId.Meters))
        pre_value = tempo_value
    return pre_value

default_interior_wall_type = UnwrapElement(IN[0])

LENGTH = convert_meter_to_unit(IN[1][1][0])
WIDTH = convert_meter_to_unit(IN[1][1][1])
CORR_WIDTH = convert_meter_to_unit(IN[1][1][2])
MIN_ROOM_LENGTH = convert_meter_to_unit(IN[1][1][3])
INCLUDE_BOTTLENECK = IN[1][1][5]

DOOR_WIDTH_H = convert_meter_to_unit(float(IN[2]) / 2.)
OBSTACLE_WIDTH  = convert_meter_to_unit(float(IN[3]))
ROOM_WIDTH = convert_meter_to_unit(float(IN[4]))
# start_level = UnwrapElement(IN[5][0])
# end_level = UnwrapElement(IN[5][1])

DOOR_THICKNESS_H = convert_meter_to_unit(0.25)
DOOR_HEIGHT = convert_meter_to_unit(2.2)

def create_edge_geometry(start_level , end_level) : 
    z_level = start_level.Elevation

    room_dict = {}
    ceiling = start_level.Elevation
    obstacle_counter = 0

    doc = DocumentManager.Instance.CurrentDBDocument
    TransactionManager.Instance.EnsureInTransaction(doc)


    x_corridor = ROOM_WIDTH + CORR_WIDTH/2.
    y_corridor = WIDTH - ROOM_WIDTH - CORR_WIDTH/2.

    y_main_corridor = 0.5*WIDTH
    x_main_corridor_start = CORR_WIDTH
    x_main_corridor_end = LENGTH-CORR_WIDTH

    p2_l = XYZ(x_corridor-CORR_WIDTH/2., CORR_WIDTH, ceiling)
    p4_l = XYZ(LENGTH-CORR_WIDTH, y_corridor+CORR_WIDTH/2., ceiling)
    p2_r = XYZ(x_corridor+CORR_WIDTH/2., CORR_WIDTH, ceiling)
    p4_r = XYZ(LENGTH-CORR_WIDTH, y_corridor-CORR_WIDTH/2., ceiling)

    corridor_lines_left = [
        Autodesk.Revit.DB.Line.CreateBound(XYZ(x_corridor-CORR_WIDTH, 0, ceiling), XYZ(x_corridor-CORR_WIDTH, CORR_WIDTH, ceiling)),
        Autodesk.Revit.DB.Line.CreateBound(XYZ(x_corridor-CORR_WIDTH, CORR_WIDTH, ceiling), p2_l),
        Autodesk.Revit.DB.Line.CreateBound(p2_l, XYZ(x_corridor-CORR_WIDTH/2., y_corridor+CORR_WIDTH/2., ceiling)),
        Autodesk.Revit.DB.Line.CreateBound(XYZ(x_corridor-CORR_WIDTH/2., y_corridor+CORR_WIDTH/2., ceiling), p4_l),
        Autodesk.Revit.DB.Line.CreateBound(p4_l, XYZ(LENGTH-CORR_WIDTH, y_corridor+CORR_WIDTH, ceiling)),
        Autodesk.Revit.DB.Line.CreateBound(XYZ(LENGTH-CORR_WIDTH, y_corridor+CORR_WIDTH, ceiling), XYZ(LENGTH, y_corridor+CORR_WIDTH, ceiling)),
    ]

    corridor_lines_right = [
        Autodesk.Revit.DB.Line.CreateBound(XYZ(x_corridor+CORR_WIDTH, 0, ceiling), XYZ(x_corridor+CORR_WIDTH, CORR_WIDTH, ceiling)),
        Autodesk.Revit.DB.Line.CreateBound(XYZ(x_corridor+CORR_WIDTH, CORR_WIDTH, ceiling), p2_r),
        Autodesk.Revit.DB.Line.CreateBound(XYZ(x_corridor+CORR_WIDTH/2., CORR_WIDTH, ceiling), XYZ(x_corridor+CORR_WIDTH/2., y_corridor-CORR_WIDTH/2., ceiling)),
        Autodesk.Revit.DB.Line.CreateBound(XYZ(x_corridor+CORR_WIDTH/2., y_corridor-CORR_WIDTH/2., ceiling), p4_r),
        Autodesk.Revit.DB.Line.CreateBound(p4_r, XYZ(LENGTH-CORR_WIDTH, y_corridor-CORR_WIDTH, ceiling)),
        Autodesk.Revit.DB.Line.CreateBound(XYZ(LENGTH-CORR_WIDTH, y_corridor-CORR_WIDTH, ceiling), XYZ(LENGTH, y_corridor-CORR_WIDTH, ceiling)),
    ]

    # assign room
    room_dict.update({
        'CROWDIT_DESTINATION_'+str(0): [
                (convert_to_meter(x_corridor-CORR_WIDTH)+0.5, convert_to_meter(0)+0.5),
                (convert_to_meter(x_corridor+CORR_WIDTH)-0.5, convert_to_meter(CORR_WIDTH)-0.5)
            ]
        }
    )

    room_dict.update({
        'CROWDIT_DESTINATION_'+str(1): [
                (convert_to_meter(LENGTH-CORR_WIDTH)+0.5, convert_to_meter(y_corridor-CORR_WIDTH)+0.5),
                (convert_to_meter(LENGTH)-0.5, convert_to_meter(y_corridor+CORR_WIDTH)-0.5)
            ]
        }
    )

    corridor_walls_left = [Wall.Create(doc, wall_l, default_interior_wall_type.Id, start_level.Id, end_level.Elevation - start_level.Elevation, 0, False, True) 
        for wall_l in corridor_lines_left]
    corridor_walls_right = [Wall.Create(doc, wall_r, default_interior_wall_type.Id, start_level.Id, end_level.Elevation - start_level.Elevation, 0, False, True) 
        for wall_r in corridor_lines_right]

    partition_openings = []

    if INCLUDE_BOTTLENECK:
        bottleneck_lines = [
            Autodesk.Revit.DB.Line.CreateBound(p2_l, p2_r),
            Autodesk.Revit.DB.Line.CreateBound(p4_l, p4_r)
        ]
        bottleneck_walls = [Wall.Create(doc, b_wall, default_interior_wall_type.Id, start_level.Id, end_level.Elevation - start_level.Elevation, 0, False, True) 
            for b_wall in bottleneck_lines]

        # some doors
        x_door_1 = (p2_l.X + p2_r.X) / 2.
        y_door_1 = (p2_l.Y + p2_r.Y) / 2.
        x_door_2 = (p4_l.X + p4_r.X) / 2.
        y_door_2 = (p4_l.Y + p4_r.Y) / 2.
        
        start_point_1 = XYZ(x_door_1-DOOR_WIDTH_H, y_door_1-DOOR_THICKNESS_H, z_level)
        end_point_1 = XYZ(x_door_1+DOOR_WIDTH_H, y_door_1+DOOR_THICKNESS_H, z_level+DOOR_HEIGHT)
        opening_1 = doc.Create.NewOpening(bottleneck_walls[0], start_point_1, end_point_1)

        start_point_2 = XYZ(x_door_2-DOOR_THICKNESS_H, y_door_2-DOOR_WIDTH_H, z_level)
        end_point_2 = XYZ(x_door_2+DOOR_THICKNESS_H, y_door_2+DOOR_WIDTH_H, z_level+DOOR_HEIGHT)
        opening_2 = doc.Create.NewOpening(bottleneck_walls[1], start_point_2, end_point_2)

    outter_office_lines = [
        Autodesk.Revit.DB.Line.CreateBound(
            XYZ(x_corridor+ROOM_WIDTH+CORR_WIDTH/2, 0, ceiling), 
            XYZ(x_corridor+ROOM_WIDTH+CORR_WIDTH/2, y_corridor - ROOM_WIDTH - CORR_WIDTH/2., ceiling)),
        Autodesk.Revit.DB.Line.CreateBound(
            XYZ(x_corridor+ROOM_WIDTH+CORR_WIDTH/2, y_corridor - ROOM_WIDTH - CORR_WIDTH/2., ceiling),
            XYZ(LENGTH, y_corridor - ROOM_WIDTH - CORR_WIDTH/2., ceiling))
    ]
    outter_office_walls = [Wall.Create(doc, o_wall, default_interior_wall_type.Id, start_level.Id, end_level.Elevation - start_level.Elevation, 0, False, True) 
            for o_wall in outter_office_lines]

    edge_room_x = ROOM_WIDTH # + CORR_WIDTH
    # edge room door
    """ start_point_edge = XYZ((edge_room_x+ROOM_WIDTH)/2.-DOOR_WIDTH_H, y_corridor+CORR_WIDTH/2.-DOOR_THICKNESS_H, z_level)
    end_point_edge = XYZ((edge_room_x+ROOM_WIDTH)/2.+DOOR_WIDTH_H, y_corridor+CORR_WIDTH/2.+DOOR_THICKNESS_H, z_level+DOOR_HEIGHT)
    partition_openings.append(doc.Create.NewOpening(corridor_walls_left[3], start_point_edge, end_point_edge))

    # assign room
    room_dict.update({
        'CROWDIT_ORIGIN_'+str(0): [
                (convert_to_meter(0)+0.5, convert_to_meter(y_corridor+CORR_WIDTH/2.)+0.5),
                (convert_to_meter(edge_room_x)-0.5, convert_to_meter(WIDTH)-0.5)
            ]
        }
    ) """

    # side rooms along y
    y_start_rooms = 2*CORR_WIDTH
    y_end_rooms_long = y_corridor + CORR_WIDTH/2.
    y_end_rooms_short = y_corridor - CORR_WIDTH/2.

    NUM_ROOMS_LONG_Y = int((y_end_rooms_long-y_start_rooms) / MIN_ROOM_LENGTH)
    NUM_ROOMS_SHORT_Y = int((y_end_rooms_short-y_start_rooms) / MIN_ROOM_LENGTH)
    fractions_partitions = [1./NUM_ROOMS_LONG_Y*i for i in range(NUM_ROOMS_LONG_Y+1)] if NUM_ROOMS_LONG_Y > 0 else []
    y_pos_partitions_long = [y_start_rooms + fr * (y_end_rooms_long - y_start_rooms) for fr in fractions_partitions] if len(fractions_partitions) > 0 else [y_start_rooms, y_end_rooms_long]
    fractions_partitions = [1./NUM_ROOMS_SHORT_Y*i for i in range(NUM_ROOMS_SHORT_Y+1)] if NUM_ROOMS_SHORT_Y > 0 else []
    y_pos_partitions_short = [y_start_rooms + fr * (y_end_rooms_short - y_start_rooms) for fr in fractions_partitions] if len(fractions_partitions) > 0 else [y_start_rooms, y_end_rooms_short]

    partition_lines = []

    for idy, y_pos_part in enumerate(y_pos_partitions_long):

        partition_lines.append(
            Autodesk.Revit.DB.Line.CreateBound(XYZ(0, y_pos_part, ceiling), XYZ(x_corridor-CORR_WIDTH/2., y_pos_part, ceiling))
        )
        if idy < len(y_pos_partitions_long)-1:
            # assign room
            room_dict.update({
                'CROWDIT_ORIGIN_'+str(idy): [
                        (convert_to_meter(0)+0.5, convert_to_meter(y_pos_part)+0.5),
                        (convert_to_meter(x_corridor-CORR_WIDTH/2.)-0.5, convert_to_meter(y_pos_partitions_long[idy+1])-0.5)
                    ]
                }
            )
            # a door
            start_point_part = XYZ(x_corridor-CORR_WIDTH/2.-DOOR_THICKNESS_H, (y_pos_partitions_long[idy+1]+y_pos_part)/2.-DOOR_WIDTH_H, z_level)
            end_point_part = XYZ(x_corridor-CORR_WIDTH/2.+DOOR_THICKNESS_H, (y_pos_partitions_long[idy+1]+y_pos_part)/2.+DOOR_WIDTH_H, z_level+DOOR_HEIGHT)
            partition_openings.append(doc.Create.NewOpening(corridor_walls_left[2], start_point_part, end_point_part))

            # obstacles
            if idy % 2 == 0:
                obstacle_length = 2.
                x_obst_min, x_obst_max = convert_to_meter(x_corridor-CORR_WIDTH/2.)+0.1, convert_to_meter(x_corridor-CORR_WIDTH/2.)+0.1+OBSTACLE_WIDTH
                y_obst_min, y_obst_max = convert_to_meter(y_pos_part)-obstacle_length/2., convert_to_meter(y_pos_part)+obstacle_length/2.

                room_dict.update({
                    'CROWDIT_OBSTACLE_'+str(obstacle_counter)+'_2_1_': [
                            (x_obst_min, y_obst_min),
                            (x_obst_max, y_obst_max)
                        ]
                    }
                )
                obstacle_counter += 1

    for idy, y_pos_part in enumerate(y_pos_partitions_short[:-1]):

        partition_lines.append(
            Autodesk.Revit.DB.Line.CreateBound(XYZ(x_corridor+CORR_WIDTH/2., y_pos_part, ceiling), XYZ(x_corridor+CORR_WIDTH/2.+ROOM_WIDTH, y_pos_part, ceiling))
        )
        if idy < len(y_pos_partitions_short)-1:
            # assign room
            room_dict.update({
                'CROWDIT_ORIGIN_'+str(idy+len(y_pos_partitions_long)-1): [
                        (convert_to_meter(x_corridor+CORR_WIDTH/2.)+0.5, convert_to_meter(y_pos_part)+0.5),
                        (convert_to_meter(x_corridor+CORR_WIDTH/2.+ROOM_WIDTH)-0.5, convert_to_meter(y_pos_partitions_short[idy+1])-0.5)
                    ]
                }
            )
            # a door
            start_point_part = XYZ(x_corridor+CORR_WIDTH/2.-DOOR_THICKNESS_H, (y_pos_partitions_short[idy+1]+y_pos_part)/2.-DOOR_WIDTH_H, z_level)
            end_point_part = XYZ(x_corridor+CORR_WIDTH/2.+DOOR_THICKNESS_H, (y_pos_partitions_short[idy+1]+y_pos_part)/2.+DOOR_WIDTH_H, z_level+DOOR_HEIGHT)
            partition_openings.append(doc.Create.NewOpening(corridor_walls_right[2], start_point_part, end_point_part))

            # obstacles
            if idy % 2 != 0:
                obstacle_length = 2.
                x_obst_min, x_obst_max = convert_to_meter(x_corridor+CORR_WIDTH/2.)-0.1-OBSTACLE_WIDTH, convert_to_meter(x_corridor+CORR_WIDTH/2.)-0.1
                y_obst_min, y_obst_max = convert_to_meter(y_pos_part)-obstacle_length/2., convert_to_meter(y_pos_part)+obstacle_length/2.

                room_dict.update({
                    'CROWDIT_OBSTACLE_'+str(obstacle_counter)+'_2_1_': [
                            (x_obst_min, y_obst_min),
                            (x_obst_max, y_obst_max)
                        ]
                    }
                )
                obstacle_counter += 1

    # side rooms along x
    x_end_rooms = LENGTH - 2*CORR_WIDTH
    x_start_rooms_long = edge_room_x
    x_start_rooms_short = x_corridor+CORR_WIDTH/2.+ROOM_WIDTH

    NUM_ROOMS_LONG_X = int((x_end_rooms-x_start_rooms_long) / MIN_ROOM_LENGTH)
    NUM_ROOMS_SHORT_X = int((x_end_rooms-x_start_rooms_short) / MIN_ROOM_LENGTH)

    fractions_partitions = [1./NUM_ROOMS_LONG_X*i for i in range(NUM_ROOMS_LONG_X+1)] if NUM_ROOMS_LONG_X > 0 else []
    x_pos_partitions_long = [x_start_rooms_long + fr * (x_end_rooms - x_start_rooms_long) for fr in fractions_partitions] if len(fractions_partitions) > 0 else [x_start_rooms_long, x_end_rooms]
    fractions_partitions = [1./NUM_ROOMS_SHORT_X*i for i in range(NUM_ROOMS_SHORT_X+1)] if NUM_ROOMS_SHORT_X > 0 else []
    x_pos_partitions_short = [x_start_rooms_short + fr * (x_end_rooms - x_start_rooms_short) for fr in fractions_partitions] if len(fractions_partitions) > 0 else [x_start_rooms_short, x_end_rooms]

    for idx, x_pos_part in enumerate(x_pos_partitions_long):

        if idx > 0:
            # Do not create a wall at x = edge_room_x
            partition_lines.append(
                Autodesk.Revit.DB.Line.CreateBound(XYZ(x_pos_part, y_corridor+CORR_WIDTH/2., ceiling), XYZ(x_pos_part, WIDTH, ceiling))
            )
        if idx < len(x_pos_partitions_long)-1:
            # assign room
            room_dict.update({
                'CROWDIT_ORIGIN_'+str(idx+len(y_pos_partitions_short)-1+len(y_pos_partitions_long)-1): [
                        (convert_to_meter(x_pos_part)+0.5, convert_to_meter(y_corridor+CORR_WIDTH/2.)+0.5),
                        (convert_to_meter(x_pos_partitions_long[idx+1])-0.5, convert_to_meter(WIDTH)-0.5)
                    ]
                }
            )
            # a door
            start_point_part = XYZ((x_pos_partitions_long[idx+1]+x_pos_part)/2.-DOOR_WIDTH_H, y_corridor+CORR_WIDTH/2.-DOOR_THICKNESS_H, z_level)
            end_point_part = XYZ((x_pos_partitions_long[idx+1]+x_pos_part)/2.+DOOR_WIDTH_H, y_corridor+CORR_WIDTH/2.+DOOR_THICKNESS_H, z_level+DOOR_HEIGHT)
            partition_openings.append(doc.Create.NewOpening(corridor_walls_left[3], start_point_part, end_point_part))

    
    for idx, x_pos_part in enumerate(x_pos_partitions_short):

        partition_lines.append(
            Autodesk.Revit.DB.Line.CreateBound(XYZ(x_pos_part, y_corridor-CORR_WIDTH/2.-ROOM_WIDTH, ceiling), XYZ(x_pos_part, y_corridor-CORR_WIDTH/2., ceiling))
        )
        if idx < len(x_pos_partitions_short)-1:
            # assign room
            room_dict.update({
                'CROWDIT_ORIGIN_'+str(idx+len(x_pos_partitions_long)-1+len(y_pos_partitions_short)-1+len(y_pos_partitions_long)-1): [
                        (convert_to_meter(x_pos_part)+0.5, convert_to_meter(y_corridor-CORR_WIDTH/2.-ROOM_WIDTH)+0.5),
                        (convert_to_meter(x_pos_partitions_short[idx+1])-0.5, convert_to_meter(y_corridor-CORR_WIDTH/2.)-0.5)
                    ]
                }
            )
            # a door
            start_point_part = XYZ((x_pos_partitions_short[idx+1]+x_pos_part)/2.-DOOR_WIDTH_H, y_corridor-CORR_WIDTH/2.-DOOR_THICKNESS_H, z_level)
            end_point_part = XYZ((x_pos_partitions_short[idx+1]+x_pos_part)/2.+DOOR_WIDTH_H, y_corridor-CORR_WIDTH/2.+DOOR_THICKNESS_H, z_level+DOOR_HEIGHT)
            partition_openings.append(doc.Create.NewOpening(corridor_walls_right[3], start_point_part, end_point_part))

    # obstacles
    # iterate through partition walls in reverse order to generate obstacles
    for idx, x_pos_part in enumerate(x_pos_partitions_long[::-1]):
        if idx % 2 == 0 and idx < len(x_pos_partitions_long)-1:
            obstacle_length = 2.
            x_obst_min, x_obst_max = convert_to_meter(x_pos_part)-obstacle_length/2., convert_to_meter(x_pos_part)+obstacle_length/2.
            y_obst_min, y_obst_max = convert_to_meter(y_corridor+CORR_WIDTH/2.)-0.1-OBSTACLE_WIDTH, convert_to_meter(y_corridor+CORR_WIDTH/2.)-0.1

            room_dict.update({
                'CROWDIT_OBSTACLE_'+str(obstacle_counter)+'_2_1_': [
                        (x_obst_min, y_obst_min),
                        (x_obst_max, y_obst_max)
                    ]
                }
            )
            obstacle_counter += 1

    for idx, x_pos_part in enumerate(x_pos_partitions_short[::-1]):
        if idx % 2 != 0:
            obstacle_length = 2.
            x_obst_min, x_obst_max = convert_to_meter(x_pos_part)-obstacle_length/2., convert_to_meter(x_pos_part)+obstacle_length/2.
            y_obst_min, y_obst_max = convert_to_meter(y_corridor-CORR_WIDTH/2.)+0.1, convert_to_meter(y_corridor-CORR_WIDTH/2.)+0.1+OBSTACLE_WIDTH

            room_dict.update({
                'CROWDIT_OBSTACLE_'+str(obstacle_counter)+'_2_1_': [
                        (x_obst_min, y_obst_min),
                        (x_obst_max, y_obst_max)
                    ]
                }
            )
            obstacle_counter += 1


    # check if as many origin areas as room doors 
    assert len(partition_openings) == len([key for key in room_dict if key.startswith('CROWDIT_ORIGIN')])

    partition_walls = [Wall.Create(doc, p_wall, default_interior_wall_type.Id, start_level.Id, end_level.Elevation - start_level.Elevation, 0, False, True) 
            for p_wall in partition_lines]
    

    TransactionManager.Instance.TransactionTaskDone()

    return room_dict

OUT = create_edge_geometry    
# ----------------------------------------
detailCreator = Python(IN[0]=multiLevelGeometryCreator, IN[1]=edgeCreationByLevel)  # CPython3
# ---------- detailCreator.python (71 lines) ----------
import clr

from System.Collections.Generic import *

clr.AddReference("RevitNodes")
import Revit

clr.ImportExtensions(Revit.Elements)
clr.ImportExtensions(Revit.GeometryConversion)

clr.AddReference("RevitServices")
import RevitServices
from RevitServices.Persistence import DocumentManager 
from RevitServices.Transactions import TransactionManager 

clr.AddReference("RevitAPI")
clr.AddReference("RevitAPIUI")

clr.AddReference('ProtoGeometry')
import Autodesk 
from Autodesk.DesignScript.Geometry import *
from Autodesk.Revit.DB import *
from Autodesk.Revit.DB.Architecture import *


def create_slab_geometry(x_min , x_max , y_min , y_max , z) : 

    bottom_left_point = XYZ(x_min , y_min , z)
    bottom_right_point = XYZ(x_max , y_min , z)
    top_right_point = XYZ(x_max , y_max , z)
    top_left_point = XYZ(x_min , y_max , z)

    bottom_line = Autodesk.Revit.DB.Line.CreateBound(bottom_left_point , bottom_right_point)
    right_vertical_line = Autodesk.Revit.DB.Line.CreateBound(bottom_right_point , top_right_point)
    top_line = Autodesk.Revit.DB.Line.CreateBound(top_right_point , top_left_point)
    left_vertical_line = Autodesk.Revit.DB.Line.CreateBound(top_left_point , bottom_left_point)

    slab_geometry = CurveArray()
    slab_geometry.Append(bottom_line)
    slab_geometry.Append(right_vertical_line)
    slab_geometry.Append(top_line)
    slab_geometry.Append(left_vertical_line)

    return slab_geometry

doc = DocumentManager.Instance.CurrentDBDocument
# TransactionManager.Instance.EnsureInTransaction(doc)

# room_dict = IN[0][0]
floor_list = IN[0][1]
allLevels = IN[0][2]
site_x , site_y = IN[0][3:]

create_edge_geometry = UnwrapElement(IN[1])

if 1:
    
    
    # floor_cutting_curve = create_slab_geometry(site_x / 8. , site_x / 2. , site_y / 4. , site_y / 2. , 0.)
    # floor_cutting = doc.Create.NewOpening(doc.GetElement(ElementId(floor_list[2].Id)), floor_cutting_curve, False)
    # floor_cutting_2 = doc.Create.NewOpening(doc.GetElement(ElementId(floor_list[1].Id)), floor_cutting_curve, False)

    room_dict = {}

    for i in range(len(allLevels) - 1) : 
        room_dict[f"level_{i}"] = create_edge_geometry(UnwrapElement(allLevels[i]) , UnwrapElement(allLevels[i + 1]))
    

    # TransactionManager.Instance.TransactionTaskDone()

    OUT = room_dict
# ----------------------------------------
crossCreationByLevel = Python(IN[0]=default_interior_wall_types, IN[1]=parameterPreprocessor, IN[2]=door_width, IN[3]=obstacle_width, IN[4]=room_width)  # CPython3; same code as edgeCreationByLevel
